# Grasshopper definition Master Plan.ghx (Grasshopper 1.0.8)
# plug-ins: LunchBox, NGon_RH8

number_of_masses = Slider(7, range=1..20)
bike_path_type = ValueList({"Complete Graph": 0, "Delayne": 1, "Geometric Spanning": 2}, selected="Geometric Spanning")
global_seed = Slider(62, range=0..100)

# ---- group: Voronoi Grid
voronoi_count = Slider(29, range=0..100)
vornoi_radius = Slider(150, range=0..150)

# ---- group: Hex Grid
hex_grid_t = Slider(0.32, range=0..1)
hex_grid_u = Slider(9, range=1..20)
hex_grid_v = Slider(8, range=1..20)

# ----
selection_type = ValueList({"Random Select": 0, "Point select": 1}, selected="Random Select")
path_width = Slider(20, range=4..20)

V = Slider(0.898, range=0..1)
U = Slider(0.841, range=0..1)
pt = ConstructPoint(XCoordinate=U, YCoordinate=V, ZCoordinate=0)

U_2 = Slider(0.321, range=0..1)
V_2 = Slider(0.187, range=0..1)
pt_2 = ConstructPoint(XCoordinate=U_2, YCoordinate=V_2, ZCoordinate=0)

U_3 = Slider(0.623, range=0..1)
V_3 = Slider(0.267, range=0..1)
pt_3 = ConstructPoint(XCoordinate=U_3, YCoordinate=V_3, ZCoordinate=0)

U_4 = Slider(0.164, range=0..1)
V_4 = Slider(0.515, range=0..1)
pt_4 = ConstructPoint(XCoordinate=U_4, YCoordinate=V_4, ZCoordinate=0)

U_5 = Slider(0.402, range=0..1)
V_5 = Slider(0.822, range=0..1)
pt_5 = ConstructPoint(XCoordinate=U_5, YCoordinate=V_5, ZCoordinate=0)

U_6 = Slider(0.876, range=0..1)
V_6 = Slider(0.121, range=0..1)
pt_6 = ConstructPoint(XCoordinate=U_6, YCoordinate=V_6, ZCoordinate=0)

U_7 = Slider(0.164, range=0..1)
V_7 = Slider(0.833, range=0..1)
pt_7 = ConstructPoint(XCoordinate=U_7, YCoordinate=V_7, ZCoordinate=0)

grid_cell_type = ValueList({"Voronoi": 0, "Hex Grid": 1}, selected="Hex Grid")
srf = Surface(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)
buildings = Mesh([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])
land_mesh = Mesh(srf)  # disabled

points_of_interest = Point([Point(-474.6445524, 385.2877683, 0), Point(-469.6421655, -887.1167489, 0), Point(204.0738222, 389.9750499, 0), Point(219.412109, -891.3344477, 0)])
site_boarder = Curve(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)
side_setbacks = Slider(20, range=0..20)

merge = Merge(Data1=pt_3, Data2=pt, Data3=pt_4, Data4=pt_2, Data5=pt_5, Data6=pt_6, Data7=pt_7)
evalsrf = EvaluateSurface(Surface=reparameterize(site_boarder), Point=merge)  # -> Point, Normal, UDirection, VDirection, Frame
subtraction = Subtraction(A=number_of_masses, B=1)
solar_analysis = GetBoolean(Toggle(False), AtLeast=1, AtMost=1, FalseValue="Off", TreeAccess=False, TrueValue="On")
global_seed_2 = GetInteger(global_seed, AtLeast=1, AtMost=1, Maximum=2147483647, Minimum=-2147483648, TreeAccess=False)
voronoi_count_2 = GetInteger(voronoi_count, AtLeast=1, AtMost=1, Maximum=2147483647, Minimum=-2147483648, TreeAccess=False)
vornoi_radius_2 = GetInteger(vornoi_radius, AtLeast=1, AtMost=1, Maximum=2147483647, Minimum=-2147483648, TreeAccess=False)
hex_grid_u_2 = GetInteger(hex_grid_u, AtLeast=1, AtMost=1, Maximum=2147483647, Minimum=-2147483648, TreeAccess=False)
hex_grid_v_2 = GetInteger(hex_grid_v, AtLeast=1, AtMost=1, Maximum=2147483647, Minimum=-2147483648, TreeAccess=False)
hex_grid_t_2 = GetNumber(hex_grid_t, AtLeast=1, AtMost=1, Maximum=1.797693135e+308, Minimum=-1.797693135e+308, TreeAccess=False)
number_of_masses_2 = GetInteger(number_of_masses, AtLeast=1, AtMost=1, Maximum=2147483647, Minimum=-2147483648, TreeAccess=False)
grid_type = GetInteger(grid_cell_type, AtLeast=1, AtMost=1, Maximum=2147483647, Minimum=-2147483648, TreeAccess=False)
selection_type_2 = GetInteger(selection_type, AtLeast=1, AtMost=1, Maximum=2147483647, Minimum=-2147483648, Prompt="Selection Type", TreeAccess=False)
path_width_2 = GetInteger(path_width, AtLeast=1, AtMost=1, Maximum=2147483647, Minimum=-2147483648, TreeAccess=False)
bike_path_type_2 = GetInteger(bike_path_type, AtLeast=1, AtMost=1, Maximum=2147483647, Minimum=-2147483648, TreeAccess=False)
subset = SubList(List=evalsrf.Point, Domain=subtraction, Wrap=False)  # -> List, Index
building_points = GetPoint(subset.List, AtLeast=1, AtMost=20, Realtime=True, TreeAccess=False)

# ---- group: Cell Logic
negative = Negative(Value=side_setbacks)
offset = OffsetCurve(Curve=site_boarder, Distance=negative, Corners=1)
populate_2d = Populate2D(Region=offset, Count=voronoi_count_2, Seed=global_seed_2)
voronoi = Voronoi(Points=populate_2d, Radius=vornoi_radius_2, Boundary=offset, BruteForceOverride=False)
hex = HexagonCells(Surface=site_boarder, UDivisions=hex_grid_u_2, VDivisions=hex_grid_v_2, TParameter=hex_grid_t_2)  # -> HexagonCells, Centers

# ----
grid_cell_type_filter = StreamFilter(Gate=grid_type, Stream0=voronoi, Stream1=hex.HexagonCells)
grid_cell_type_filter_2 = StreamFilter(Gate=grid_type, Stream0=populate_2d, Stream1=hex.Centers)

# ---- group: Random Point Select Logic
lng = ListLength(List=grid_cell_type_filter)
subtraction_2 = Subtraction(A=lng, B="1")
random = Random(Range=subtraction_2, Number=number_of_masses_2, Seed=2, Integers=True)
cp = ClosestPoint(Point=building_points, Cloud=grid_cell_type_filter_2)  # -> ClosestPoint, CPIndex, Distance

# ----
selection_type_filter = StreamFilter(Gate=selection_type_2, Stream0=random, Stream1=cp.CPIndex)
item = ListItem(List=grid_cell_type_filter, Index=selection_type_filter, Wrap=True)

area = Area(Geometry=item)  # -> Area, Centroid
merge_2 = Merge(Data1=flatten(area.Centroid), Data2=flatten(points_of_interest))

crossref = CrossReference(ListA=merge_2, ListB=merge_2, CrossMode=1)  # -> ListA, ListB
ln = Line(StartPoint=crossref.ListA, EndPoint=crossref.ListB)
clean = CleanTree(RemoveNulls=True, RemoveInvalid=True, RemoveEmpty=False, Tree=ln)

con = DelaunayEdges(Points=merge_2, Plane=PlaneXY(0, 0, 0))  # -> Connectivity, Edges
c_script = CSharpScript(P=merge_2, T=Slider(1.55, range=1..10))  # -> out, A; inputs P: list of Point3d, T: Double
# ---------- c_script: C# ----------
// Grasshopper Script Instance
#region Usings
using System;
using System.Linq;
using System.Collections;
using System.Collections.Generic;
using System.Drawing;

using Rhino;
using Rhino.Geometry;

using Grasshopper;
using Grasshopper.Kernel;
using Grasshopper.Kernel.Data;
using Grasshopper.Kernel.Types;
#endregion

public class Script_Instance : GH_ScriptInstance
{
    #region Notes
    /* 
      Members:
        RhinoDoc RhinoDocument
        GH_Document GrasshopperDocument
        IGH_Component Component
        int Iteration

      Methods (Virtual & overridable):
        Print(string text)
        Print(string format, params object[] args)
        Reflect(object obj)
        Reflect(object obj, string method_name)
    */
    #endregion

    
private void RunScript(List<Point3d> P, double T, ref object A)
{
    if (P == null || P.Count < 2) return;
    if (T < 1.0) T = 1.0;

    int n = P.Count;
    List<Line> spannerEdges = new List<Line>();
    
    // 1. Create all possible edges and sort by length
    var potentialEdges = new List<Edge>();
    for (int i = 0; i < n; i++) {
        for (int j = i + 1; j < n; j++) {
            potentialEdges.Add(new Edge(i, j, P[i].DistanceTo(P[j])));
        }
    }
    potentialEdges = potentialEdges.OrderBy(e => e.Length).ToList();

    // 2. Greedy selection
    // Adjacency list to store the graph as we build it
    var adj = new List<List<Edge>>();
    for (int i = 0; i < n; i++) adj.Add(new List<Edge>());

    foreach (var edge in potentialEdges) {
        double directDist = edge.Length;
        double threshold = T * directDist;

        // Check if a path exists within the threshold using Dijkstra
        double currentShortestPath = GetShortestPath(edge.U, edge.V, adj, n, threshold);

        if (currentShortestPath > threshold) {
            // Path is too long (or doesn't exist), so add this edge
            adj[edge.U].Add(edge);
            adj[edge.V].Add(new Edge(edge.V, edge.U, edge.Length));
            spannerEdges.Add(new Line(P[edge.U], P[edge.V]));
        }
    }

    A = spannerEdges;
}

// Simple Dijkstra Implementation
private double GetShortestPath(int start, int end, List<List<Edge>> adj, int n, double limit) {
    double[] dists = new double[n];
    for (int i = 0; i < n; i++) dists[i] = double.MaxValue;
    dists[start] = 0;

    var pq = new SortedSet<(double dist, int node)>();
    pq.Add((0, start));

    while (pq.Count > 0) {
        var current = pq.Min;
        pq.Remove(current);

        if (current.node == end) return current.dist;
        if (current.dist > limit) return double.MaxValue; // Optimization

        foreach (var edge in adj[current.node]) {
            double newDist = current.dist + edge.Length;
            if (newDist < dists[edge.V]) {
                pq.Remove((dists[edge.V], edge.V));
                dists[edge.V] = newDist;
                pq.Add((newDist, edge.V));
            }
        }
    }
    return double.MaxValue;
}

// Helper Class
public class Edge {
    public int U, V;
    public double Length;
    public Edge(int u, int v, double len) { U = u; V = v; Length = len; }
}
}
# ---------- end c_script ----------

lng_2 = ListLength(List=item)
random_2 = Random(Range="24 to 168", Number=lng_2, Seed=global_seed_2, Integers=True)
unit_z = UnitZ(Factor=random_2)
extrude = Extrude(Base=item, Direction=unit_z)
cap_holes = CapHoles(Brep=extrude)

division = Division(A=path_width_2, B=2)
building_cells = Data(item)

filter = StreamFilter(Gate=bike_path_type_2, Stream0=clean, Stream1=con.Edges, Stream2=c_script.A)

xy = XYPlane(Origin=Point(0, 0, 0))
ext = ExtendCurve(Curve=filter, Type=0, Start=division, End=division)
neg = Negative(Value=division)
offset_2 = OffsetCurve(Curve=ext, Distance=graft([division, neg]), Plane=xy, Corners=1)
trim = TrimTree(Tree=offset_2, Depth=1)
flip = FlipMatrix(Data=trim)
loft = Loft(Curves=flip, Options={Adjust=False, Closed=False, LoftEnds=0, LoftSimp=0, LoftType=0, Rebuild=10, Refit=0.01})
rdiff = RegionDifference(CurvesA=loft, CurvesB=building_cells)
clean_2 = CleanTree(RemoveNulls=True, RemoveInvalid=True, RemoveEmpty=True, Tree=rdiff)
boundary = BoundarySurfaces(Edges=clean_2)
runion = RegionUnion(Curves=flatten(boundary))
boundary_2 = BoundarySurfaces(Edges=runion)
flip_2 = Flip(Surface=boundary_2, Guide=srf)  # -> Surface, Result

building_masses = Data(cap_holes)
bike_paths = Data(flip_2.Surface)
context = Data(building_masses)
geomertry = Data(bike_paths)
number_slider = Slider(0.01, range=0..0.01)

analysisperiod = LBAnalysisPeriod(start_month=1, start_day=1, start_hour=0)  # -> period, hoys, dates; plug-in component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
constrloc = LBConstructLocation(name="Orlando.Intl.AP", latitude=28.43333, longitude=-81.31667, time_zone=-5, elevation=32)  # -> location; plug-in component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
sunpath = LBSunPath(location=constrloc, hoys=analysisperiod.hoys, scale=1)  # -> report, vectors, altitudes, azimuths, hoys, sun_pts, analemma, daily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; plug-in component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
directsunhours = LBDirectSunHours(
    vectors=flatten(sunpath.vectors),
    geometry=flatten(geomertry),
    context=flatten(context),
    grid_size=Slider(20, range=0..100),
    offset_dist=Slider(0.1, range=0..0.1),
    run=solar_analysis)  # -> report, points, results, mesh, legend, title, int_mtx; plug-in component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
ma = MassAddition(Input=directsunhours.results)  # -> Result, PartialResults

directsunhours_2 = LBDirectSunHours(vectors=flatten(sunpath.vectors))  # -> report, points, results, mesh, legend, title, int_mtx; plug-in component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
avr = Average(Input=directsunhours.results)
panel = Panel("Turn on Solar Analysis to see average hours of annual sun exposure.")
bike_paths_2 = Data(flip_2.Surface)
mesh = Mesh(bike_paths_2)
concat = Concatenate(FragmentA=avr, FragmentB=" Hr/Year")
filter_2 = StreamFilter(Gate=solar_analysis, Stream0=panel, Stream1=concat)
filter_3 = StreamFilter(Gate=solar_analysis, Stream0=mesh, Stream1=directsunhours.mesh)
mesh_2 = Mesh(building_masses)
c_bake = ContextBake(BuildingMasses=mesh_2)
c_bake_2 = ContextBake(SiteContext=[buildings, land_mesh])
c_bake_3 = ContextBake(BikePaths=filter_3)
c_print = ContextPrint(Results=filter_2)

offset_3 = PolylineOffset(Curve=filter, Distance=division, Divisions=0)  # -> C, H
merge_3 = Merge(Data2=building_cells)
runion_2 = RegionUnion(Curves=flatten(merge_3))

rdiff_2 = RegionDifference(CurvesA=offset_3.C, CurvesB=runion_2)

boundary_3 = BoundarySurfaces(Edges=flatten(rdiff_2))
flip_3 = Flip(Surface=boundary_3, Guide=srf)  # -> Surface, Result
