# Grasshopper definition Populus Single Eye on Panel.ghx (Grasshopper 1.0.8)
# plug-ins: Sasquatch

# ----
# Upper Brow Controls
upper_b_corner_extension = Slider(24, range=0..48)
upper_b_extrusion = Slider(10, range=0..100)
upper_b_to_c_thickness = Slider(2, range=0..18)
upper_a_height = Slider(18, range=0..48)
upper_b_height = Slider(96, range=0..200)
b_width = Slider(81, range=0..96)

# ----
# Lower Brow Controls
lower_b_corner_extension = Slider(0, range=0..20)
lower_b_extrusion = Slider(4, range=0..100)
lower_d_slope_angle = Slider(8, range=0..45)
lower_b_to_c_thickness = Slider(1, range=0..18)
lower_a_height = Slider(6.5, range=0..48, expression="-x")
lower_b_height = Slider(94, range=0..96, expression="-x")
b_width_2 = Slider(81, range=0..96)

# ----
# Start HERE
base_panel_srf = Surface(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)
input_type = ValueList({"Testing": 0, "Single": 1, "Many": 2, "Input": 3, "Pattern": 4}, selected="Testing")
back_of_scallop = Curve(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)

# ----
# Curve A
# Curve B
# Curve C
# Curve D
image = ImageSampler(Filter="Colour", Interpolate=False, Umax=1, Umin=0, Vmax=1, Vmin=0, Wrap=1)
image_2 = ImageSampler(Filter="Colour", Interpolate=False, Umax=1, Umin=0, Vmax=1, Vmin=0, Wrap=1)
image_3 = ImageSampler(Filter="Colour", Interpolate=False, Umax=1, Umin=0, Vmax=1, Vmin=0, Wrap=1)
image_4 = ImageSampler(Filter="Colour", Interpolate=False, Umax=1, Umin=0, Vmax=1, Vmin=0, Wrap=1)

lower_b_extrusion_2 = GetNumber(lower_b_extrusion, AtLeast=1, AtMost=1, Maximum=100, Minimum=0, TreeAccess=False)
lower_b_to_c_thickness_2 = GetNumber(lower_b_to_c_thickness, AtLeast=1, AtMost=1, Maximum=18, Minimum=0, TreeAccess=False)
lower_b_height_2 = GetNumber(lower_b_height, AtLeast=1, AtMost=1, Maximum=0, Minimum=-96, TreeAccess=False)
lower_b_corner_extension_2 = GetNumber(lower_b_corner_extension, AtLeast=1, AtMost=1, Maximum=20, Minimum=0, TreeAccess=False)
lower_d_slope_angle_2 = GetNumber(lower_d_slope_angle, AtLeast=1, AtMost=1, Maximum=45, Minimum=0, TreeAccess=False)
lower_a_height_2 = GetNumber(lower_a_height, AtLeast=1, AtMost=1, Maximum=0, Minimum=-48, TreeAccess=False)
upper_b_extrusion_2 = GetNumber(upper_b_extrusion, AtLeast=1, AtMost=1, Maximum=100, Minimum=0, TreeAccess=False)
upper_b_to_c_thickness_2 = GetNumber(upper_b_to_c_thickness, AtLeast=1, AtMost=1, Maximum=18, Minimum=0, TreeAccess=False)
upper_b_corner_extension_2 = GetNumber(upper_b_corner_extension, AtLeast=1, AtMost=1, Maximum=48, Minimum=0, TreeAccess=False)
upper_b_height_2 = GetNumber(upper_b_height, AtLeast=1, AtMost=1, Maximum=200, Minimum=0, TreeAccess=False)
upper_a_height_2 = GetNumber(upper_a_height, AtLeast=1, AtMost=1, Maximum=48, Minimum=1, TreeAccess=False)
b_width_3 = GetNumber(b_width, AtLeast=1, AtMost=1, Maximum=96, Minimum=1, TreeAccess=False)

pt = ConstructPoint(XCoordinate=".5", YCoordinate="118/236", ZCoordinate=0)

# ----
# Global Brow Controls
d_return_depth = Slider(25.5, range=-48..48)
list = ValueList({"Projected": 0, "Not Projected": 1}, selected="Projected")

# ----
# Testing Entry
# (Manually define a single
#  eye shape and location)
panel = Panel(pt)
pt_2 = ConstructPoint(XCoordinate=b_width_3, YCoordinate=b_width_3, ZCoordinate=0)
merge = Merge(
    Data1=base_panel_srf,
    Data2=panel,
    Data3=pt_2,
    Data4=d_return_depth,
    Data5=upper_a_height_2,
    Data6=upper_b_height_2,
    Data7=upper_b_corner_extension_2,
    Data8=upper_b_extrusion_2,
    Data9=upper_b_to_c_thickness_2,
    Data10=lower_a_height_2,
    Data11=lower_b_height_2,
    Data12=lower_b_corner_extension_2,
    Data13=lower_b_extrusion_2,
    Data14=lower_b_to_c_thickness_2,
    Data15=lower_d_slope_angle_2)  # -> graft(Result)

bang = ExplodeTree(Data=merge)  # -> simplify(graft(Branch0)), simplify(graft(Branch1)), simplify(graft(Branch2)), simplify(graft(Branch3)), simplify(graft(Branch4)), simplify(graft(Branch5)), simplify(graft(Branch6)), simplify(graft(Branch7))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
addition = Addition(A=bang.Branch3, B=bang.Branch12)
tan = Tangent(Value=degrees(bang.Branch14))
multiplication = Multiplication(A=addition, B=tan)
pdecon = Deconstruct(Point=bang.Branch2)  # -> XComponent, YComponent, ZComponent
neg = Negative(Value=bang.Branch13)
list_2 = ValueList({"Trimmed": 0, "Untrimmed Projected": 1, "Untrimmed": 2}, selected="Untrimmed Projected")
list_3 = ValueList({"Trimmed": 0, "Untrimmed Projected": 1, "Untrimmed": 2}, selected="Trimmed")
filter = StreamFilter(Gate=0, Stream0=list_2, Stream1=list_3)
list_4 = ValueList({"Trimmed": 0, "Untrimmed Projected": 1, "Untrimmed": 2}, selected="Trimmed")
toggle = BooleanToggle(True)
toggle_2 = BooleanToggle(False)
neg_2 = Negative(Value=neg)
filter_2 = StreamFilter(Gate=toggle, Stream0=neg, Stream1=neg_2)
brow_construction = BrowConstruction(
    base_surface=bang.Branch0,
    portal_coordinates=bang.Branch1,
    b_width=pdecon.YComponent,
    a_height_above_b=bang.Branch9,
    b_height=bang.Branch10,
    b_corner_extension=bang.Branch11,
    b_distance_from_surface=bang.Branch12,
    b_to_c_thickness=filter_2,
    a_crv_type=list,
    a_crv_type_2=list_3,
    a_crv_type_3=toggle_2,
    planar_b_to_c=toggle)  # -> brow_crvs_2, local_plane_2, global_plane_2
brow_construction_2 = BrowConstruction(
    base_surface=bang.Branch0,
    portal_coordinates=bang.Branch1,
    b_width=pdecon.XComponent,
    a_height_above_b=bang.Branch4,
    b_height=bang.Branch5,
    b_corner_extension=bang.Branch6,
    b_distance_from_surface=bang.Branch7,
    b_to_c_thickness=bang.Branch8,
    a_crv_type=list,
    a_crv_type_2=list_4,
    a_crv_type_3=toggle_2,
    planar_b_to_c=Toggle(True))  # -> brow_crvs_2, local_plane_2, global_plane_2
tan_2 = Tangent(Value=degrees(bang.Branch14))
multiplication_2 = Multiplication(A=bang.Branch3, B=tan_2)

construction_type = ValueList({"Continuous Loft": 0, "Paired Loft": 1, "Ruled Pairs": 2, "2 Rail Sweep": 3, "Bifercate Sweep 2": 4}, selected="Bifercate Sweep 2")
rebuild = BooleanToggle(True)
loft_opt = LoftOptions(Closed=False, Adjust=True, Rebuild=Slider(0, range=0..10), Refit=Slider(0.5, range=0..1), Type=3)

# ---- group: Return surface
deplane = DeconstructPlane(Plane=brow_construction_2.local_plane_2)  # -> Origin, XAxis, YAxis, ZAxis
item = ListItem(List=brow_construction_2.brow_crvs_2, Index=3, Wrap=True)
multiplication_3 = Multiplication(A=deplane.ZAxis, B=bang.Branch3)
project = Project(Geometry=item, Plane=brow_construction_2.local_plane_2)  # -> Geometry, Transform
neg_3 = Negative(Value=multiplication_3)
move = Move(Geometry=project.Geometry, Motion=neg_3)  # -> Geometry, Transform
replace = ReplaceItems(List=brow_construction_2.brow_crvs_2, Item=move.Geometry, Indices=3, Wrap=False)
trim = TrimTree(Tree=replace, Depth=1)

deplane_2 = DeconstructPlane(Plane=brow_construction.global_plane_2)  # -> Origin, XAxis, YAxis, ZAxis
item_2 = ListItem(List=brow_construction.brow_crvs_2, Index=3, Wrap=True)
multiplication_4 = Multiplication(A=deplane_2.ZAxis, B=bang.Branch3)
multiplication_5 = Multiplication(A=deplane_2.YAxis, B=multiplication)
project_2 = Project(Geometry=item_2, Plane=brow_construction.global_plane_2)  # -> Geometry, Transform
neg_4 = Negative(Value=multiplication_4)
addition_2 = Addition(A=neg_4, B=multiplication_5)
move_2 = Move(Geometry=project_2.Geometry, Motion=addition_2)  # -> Geometry, Transform
replace_2 = ReplaceItems(List=brow_construction.brow_crvs_2, Item=move_2.Geometry, Indices=3, Wrap=False)
trim_2 = TrimTree(Tree=replace_2, Depth=1)

# ----
# Brow Curves to Surfaces
curves_with_return = Curve(trim)
curves_with_return_2 = Curve(trim_2)
brow_construction_3 = BrowConstruction_2(
    curves_with_return=curves_with_return,
    local_plane=brow_construction_2.local_plane_2,
    solid=Toggle(True),
    simplify=rebuild,
    construction_type=construction_type,
    loft_options=loft_opt)
brow_construction_4 = BrowConstruction_2(
    curves_with_return=curves_with_return,
    local_plane=brow_construction_2.local_plane_2,
    solid=Toggle(False),
    simplify=rebuild,
    construction_type=construction_type,
    loft_options=loft_opt)  # -> graft(brow_2)
brow_construction_5 = BrowConstruction_2(
    curves_with_return=curves_with_return_2,
    local_plane=brow_construction.local_plane_2,
    solid=Toggle(True),
    simplify=rebuild,
    construction_type=construction_type,
    loft_options=loft_opt)
brow_construction_6 = BrowConstruction_2(
    curves_with_return=curves_with_return_2,
    local_plane=brow_construction.local_plane_2,
    solid=Toggle(False),
    simplify=rebuild,
    construction_type=construction_type,
    loft_options=loft_opt)  # -> graft(brow_2)
cap = CapHoles(Brep=brow_construction_5)
cap_2 = CapHoles(Brep=brow_construction_3)

# ---- group: Trim Bottom to match Top
scallope = Data(bang.Branch0)
solid_top_brow = Data(cap_2)
open_bottom_brow = Data(brow_construction_6)
trim_3 = TrimSolid(Shape=open_bottom_brow, Cutters=solid_top_brow)
item_3 = ListItem(List=trim_3, Index=0, Wrap=True)
split = SplitBrep(Brep=item_3, Cutter=scallope)
trim_4 = TrimTree(Tree=split, Depth=2)
item_4 = ListItem(List=trim_4, Index=0, Wrap=True)  # -> Item, Item1, Item2, Item3
brow = Brep(item_4.Item)
return = Brep(item_4.Item1)

# ----
outer_glazing_distance_from_grid_line = Panel("0")
item_5 = ListItem(List=flatten(bang.Branch0), Index=0, Wrap=True)
evalsrf = EvaluateSurface(Surface=reparameterize(item_5), Point=Point(0.5, 0.5, 0))  # -> Point, Normal, UDirection, VDirection, Frame
area = Area(Geometry=return)  # -> Area, Centroid
sort = SortList(Keys=area.Area, ValuesA=return)  # -> Keys, ValuesA

Z = UnitZ(Factor=1)
deplane_3 = DeconstructPlane(Plane=evalsrf.Frame)  # -> Origin, XAxis, YAxis, ZAxis
extr = Extrude(Base=back_of_scallop, Direction=Z)
amp = Amplitude(Vector=deplane_3.ZAxis, Amplitude=outer_glazing_distance_from_grid_line)
pln = Plane(extr)
move_3 = Move(Geometry=pln, Motion=amp)  # -> Geometry, Transform
trimpl = TrimWithPlane(Brep=sort.ValuesA, Plane=move_3.Geometry, PlaneDirection=True, Cap=True, Tolerance=0.001)

item_6 = ListItem(List=flatten(bang.Branch0), Index=0, Wrap=True)
merge_2 = Merge(Data1=graft(brow_construction_2.brow_crvs_2), Data2=graft(brow_construction.brow_crvs_2))
flip = FlipMatrix(Data=merge_2)
item_7 = ListItem(List=flip, Index=0, Wrap=True)  # -> Item, Item1, Item2, Item3
pshift = ShiftPaths(Data=item_7.Item, Offset=-1)
pshift_2 = ShiftPaths(Data=item_7.Item1, Offset=-1)
pshift_3 = ShiftPaths(Data=item_7.Item2, Offset=-1)
pshift_4 = ShiftPaths(Data=item_7.Item3, Offset=-1)
c_bake = ContextBake(Content=pshift_2)
c_bake_2 = ContextBake(Content=pshift_3)
c_bake_3 = ContextBake(Content=pshift_4)
c_bake_4 = ContextBake(Content=pshift)

# ---- group: Trim Top to match Bottom
solid_bottom_brow = Data(cap)
scallope_2 = Data(bang.Branch0)
open_top_brow = Data(brow_construction_4)
split_2 = SplitBrep(Brep=open_top_brow, Cutter=scallope_2)
item_8 = ListItem(List=split_2, Index=0, Wrap=True)  # -> Item1, Item
trim_5 = TrimSolid(Shape=[item_8.Item, item_8.Item1], Cutters=solid_bottom_brow)
trim_6 = TrimTree(Tree=trim_5, Depth=1)

# ----
item_9 = ListItem(List=trim_6, Index=0, Wrap=True)  # -> Item1, Item, Item1_2, Item2

# ---- group: Trim Top to match Bottom (continued)
brow_2 = Data(item_9.Item)
return_2 = Data([item_9.Item1, item_9.Item1_2, item_9.Item2])

# ----
merge_3 = Merge(Data1=brow_2, Data2=brow)  # -> flatten(Result)
area_2 = Area(Geometry=return_2)  # -> Area, Centroid

# ---- group: Panel Cut
bottom_brow_w_o_return = Data(brow)
top_brow_w_o_return = Data(brow_2)
merge_4 = Merge(Data1=top_brow_w_o_return, Data2=bottom_brow_w_o_return)
project_3 = Project(Geometry=merge_4, Plane=brow_construction.global_plane_2)  # -> Geometry, Transform
runion = RegionUnion(Curves=project_3.Geometry, Plane=brow_construction.global_plane_2)
item_10 = ListItem(List=runion, Index=0, Wrap=True)  # -> Item, Item1
project_4 = Project(Curve=item_10.Item, Brep=bang.Branch0, Direction=deplane.ZAxis)
srfsplit = SurfaceSplit(Surface=item_6, Curves=flatten(project_4))
item_11 = ListItem(List=srfsplit, Index=0, Wrap=True)
panel_srf = Surface(item_11)

# ----
sort_2 = SortList(Keys=area_2.Area, ValuesA=return_2)  # -> Keys, ValuesA
item_12 = ListItem(List=sort_2.ValuesA, Index=-1, Wrap=True)

glass_line = Curve(back_of_scallop)
Z_2 = UnitZ(Factor=1)
deplane_4 = DeconstructPlane(Plane=evalsrf.Frame)  # -> Origin, XAxis, YAxis, ZAxis
pln_2 = Plane(glass_line)
extr_2 = Extrude(Base=glass_line, Direction=Z_2)
amp_2 = Amplitude(Vector=deplane_4.ZAxis, Amplitude=outer_glazing_distance_from_grid_line)
pln_3 = Plane(extr_2)
move_4 = Move(Geometry=pln_3, Motion=amp_2)  # -> Geometry, Transform
trimpl_2 = TrimWithPlane(Brep=item_12, Plane=move_4.Geometry, PlaneDirection=True, Cap=True, Tolerance=0.001)

entwine = Entwine(
    Branch00=panel_srf,
    Branch01=top_brow_w_o_return,
    Branch02=bottom_brow_w_o_return,
    Branch03=trimpl_2,
    Branch04=trimpl,
    FlattenInputs=True)
trim_7 = TrimTree(Tree=entwine, Depth=1)
join = BrepJoin(Breps=trim_7)  # -> Breps, Closed
planar = IsPlanar(Surface=join.Breps, Interior=True)  # -> Planar, Plane
nullrep = ReplaceNulls(Items=planar.Planar, Replacements="True")  # -> Items, Count
sift = SiftPattern(List=join.Breps, SiftPattern=nullrep.Items)  # -> Output0, Output1
clean = CleanTree(RemoveNulls=True, RemoveInvalid=True, RemoveEmpty=False, Tree=sift.Output1)  # -> flatten(Tree)
thin_gfrc = Data(clean)
c_bake_5 = ContextBake(ThinGFRC=thin_gfrc)

# ==== cluster BrowConstruction
base_surface = ClusterInput()
portal_coordinates = ClusterInput()
b_width = ClusterInput()
a_height_above_b = ClusterInput()
b_height = ClusterInput()
b_corner_extension = ClusterInput()
b_distance_from_surface = ClusterInput()
b_to_c_thickness = ClusterInput()
a_crv_type = ClusterInput()
a_crv_type_2 = ClusterInput()
a_crv_type_3 = ClusterInput()
b_distance_from_surface_2 = Data(b_distance_from_surface)
b_corner_extension_2 = Data(b_corner_extension)
portal_coordinates_2 = Data(portal_coordinates)
a_height_above_b_2 = Data(a_height_above_b)
b_to_c_thickness_2 = Data(b_to_c_thickness)
curve_c_type = Data(a_crv_type_2)
curve_a_type = Data(a_crv_type)
base_surface_2 = Surface(base_surface)
return_type = Data(a_crv_type_3)
b_height_2 = Data(b_height)
b_width_2 = Data(b_width)

# ----
# Brow XYZ
evalsrf = EvaluateSurface(Surface=reparameterize(base_surface_2), Point=portal_coordinates_2)  # -> Point, Normal, UDirection, VDirection, Frame
deplane = DeconstructPlane(Plane=evalsrf.Frame)  # -> Origin, XAxis, YAxis, ZAxis
x_vector = Vector(deplane.XAxis)
y_vector = Vector(deplane.YAxis)
z_vector = Vector(deplane.ZAxis)

# ---- group: Corners
multiplication = Multiplication(A=x_vector, B=b_width_2)
neg = Negative(Value=multiplication)
move = Move(Geometry=evalsrf.Frame, Motion=expr("x/2", [neg, multiplication]))  # -> Geometry, Transform

# ---- group: Global Plane
evalsrf_2 = EvaluateSurface(Surface=reparameterize(base_surface_2), Point=Point(0.5, 0.5, 0))  # -> Point, Normal, UDirection, VDirection, Frame

# ---- group: Initial Crv
multiplication_2 = Multiplication(A=b_height_2, B=y_vector)
move_2 = Move(Geometry=evalsrf.Frame, Motion=multiplication_2)  # -> Geometry, Transform
item = ListItem(List=move.Geometry, Index=0, Wrap=True)  # -> Item, Item1
merge = Merge(Data1=item.Item, Data2=move_2.Geometry, Data3=item.Item1)
intcrv = Interpolate(Vertices=merge, Degree=3, Periodic=False, KnotStyle=1)  # -> Curve, Length, Domain
reb = RebuildCurve(Curve=intcrv.Curve, Degree=2, Count=3, Tangents=False)
upper_lid_crv = Curve(reb)

# ----
filter = StreamFilter(Gate=return_type, Stream0=evalsrf.Normal, Stream1=evalsrf_2.Normal)
filter_2 = StreamFilter(Gate=return_type, Stream0=evalsrf.Frame, Stream1=evalsrf_2.Frame)

# ---- group: Brow Crv Extended
ext = ExtendCurve(Curve=upper_lid_crv, Type=2, Start=b_corner_extension_2, End=b_corner_extension_2)
project = Project(Curve=ext, Brep=base_surface_2, Direction=z_vector)
trim = TrimTree(Tree=project, Depth=1)
upper_brow_crv_extended = Curve(trim)

# ---- group: Crv A
addition = Addition(A=b_height_2, B=a_height_above_b_2)
multiplication_3 = Multiplication(A=addition, B=y_vector)
end = EndPoints(Curve=upper_brow_crv_extended)  # -> Start, End
move_3 = Move(Geometry=evalsrf.Frame, Motion=multiplication_3)  # -> Geometry, Transform
merge_2 = Merge(Data1=end.Start, Data2=move_3.Geometry, Data3=end.End)
intcrv_2 = Interpolate(Vertices=merge_2, Degree=3, Periodic=False, KnotStyle=1)  # -> Curve, Length, Domain
reb_2 = RebuildCurve(Curve=intcrv_2.Curve, Degree=2, Count=3, Tangents=False)
project_2 = Project(Curve=reb_2, Brep=base_surface_2, Direction=z_vector)
trim_2 = TrimTree(Tree=project_2, Depth=1)

# ---- group: Crv B
multiplication_4 = Multiplication(A=b_distance_from_surface_2, B=z_vector)
multiplication_5 = Multiplication(A=b_height_2, B=y_vector)
addition_2 = Addition(A=multiplication_5, B=multiplication_4)
move_4 = Move(Geometry=evalsrf.Frame, Motion=addition_2)  # -> Geometry, Transform
end_2 = EndPoints(Curve=upper_brow_crv_extended)  # -> Start, End
merge_3 = Merge(Data1=end_2.Start, Data2=move_4.Geometry, Data3=end_2.End)
intcrv_3 = Interpolate(Vertices=merge_3, Degree=3, Periodic=False, KnotStyle=1)  # -> Curve, Length, Domain
reb_3 = RebuildCurve(Curve=intcrv_3.Curve, Degree=2, Count=3, Tangents=False)

# ----
planar_b_to_c = ClusterInput()
planar_b_to_c_2 = Data(planar_b_to_c)
neg_2 = Negative(Value=b_to_c_thickness_2)
filter_3 = StreamFilter(Gate=planar_b_to_c_2, Stream0=evalsrf.Frame)
filter_4 = StreamFilter(Gate=planar_b_to_c_2, Stream0=b_to_c_thickness_2, Stream1=neg_2)
filter_5 = StreamFilter(Gate=curve_a_type, Stream0=trim_2, Stream1=reb_2)
local_plane = Plane(evalsrf.Frame)
global_plane = Plane(filter_2)
local_plane_2 = ClusterOutput(local_plane)
global_plane_2 = ClusterOutput(global_plane)

# ---- group: Crv C
offset = OffsetCurve(Curve=reb_3, Distance=filter_4, Plane=filter_3, Corners=1)
trim_3 = TrimTree(Tree=offset, Depth=1)
split = SplitWithBrep(Curve=trim_3, Brep=base_surface_2)  # -> Curve, Points
trim_4 = TrimTree(Tree=split.Curve, Depth=1)

# ----
filter_6 = StreamFilter(Gate=planar_b_to_c_2, Stream0=trim_4, Stream1=trim_3)

# ---- group: Crv C (continued)
item_2 = ListItem(List=filter_6, Index=0, Wrap=True)  # -> Item, Item1, Item2

# ---- group: Crv C Alt 1
merge_4 = Merge(Data1=item_2.Item, Data2=item_2.Item2)
project_3 = Project(Curve=merge_4, Brep=base_surface_2, Direction=filter)
trim_5 = TrimTree(Tree=project_3, Depth=1)
join = JoinCurves(Curves=[item_2.Item1, trim_5], Preserve=False)
trim_6 = TrimTree(Tree=join, Depth=1)

# ----
filter_7 = StreamFilter(Gate=curve_c_type, Stream0=item_2.Item1, Stream1=trim_6, Stream2=trim_3)
project_4 = Project(Curve=filter_7, Brep=base_surface_2, Direction=filter)
trim_7 = TrimTree(Tree=project_4, Depth=1)
merge_5 = Merge(Data1=filter_5, Data2=reb_3, Data3=filter_7, Data4=trim_7)
brow_crvs = Curve(merge_5)
brow_crvs_2 = ClusterOutput(brow_crvs)

# ==== cluster BrowConstruction_2
curves_with_return = ClusterInput()
local_plane = ClusterInput()
solid = ClusterInput()
simplify = ClusterInput()
construction_type = ClusterInput()
loft_options = ClusterInput()

# ---- group: Open Brow
curves_with_return_2 = Curve(curves_with_return)
construction_type_2 = Data(construction_type)
loft_options_2 = Data(loft_options)
local_plane_2 = Data(local_plane)
simplify_2 = Data(simplify)
solid_2 = Data(solid)
simplify_3 = SimplifyCurve(Curve=curves_with_return_2)  # -> Curve, Simplified
filter = StreamFilter(Gate=simplify_2, Stream0=curves_with_return_2, Stream1=simplify_3.Curve)

# ---- group: Open Brow / Solid or open
lng = ListLength(List=filter)
item = ListItem(List=filter, Index=0, Wrap=True)  # -> Item1, Item
ins = InsertItems(List=filter, Item=item.Item, Indices=lng, Wrap=True)
filter_2 = StreamFilter(Gate=solid_2, Stream0=filter, Stream1=ins)

# ---- group: Open Brow / 2 Rail Sweep
pairs = Pairs(list=filter_2)  # -> A, B
mp = Midpoint(Curve=[pairs.A, pairs.B])
pline = PolyLine(Vertices=mp, Closed=False)
swp2 = Sweep2(Rail1=reparameterize(pairs.A), Rail2=reparameterize(pairs.B), Sections=pline, SameHeight=False)
flip = FlipCurve(Curve=pairs.A)  # -> Curve, Flag
flip_2 = FlipCurve(Curve=pairs.B)  # -> Curve, Flag
swp2_2 = Sweep2(Rail1=reparameterize(flip.Curve), Rail2=reparameterize(flip_2.Curve), Sections=pline, SameHeight=False)
trim = TrimTree(Tree=[swp2_2, swp2], Depth=2)
join = BrepJoin(Breps=trim)  # -> Breps, Closed

# ---- group: Open Brow / Ruled Srf
pairs_2 = Pairs(list=filter_2)  # -> A, B
rulesrf = RuledSurface(CurveA=reparameterize(pairs_2.A), CurveB=reparameterize(pairs_2.B))
trim_2 = TrimTree(Tree=rulesrf, Depth=1)
join_2 = BrepJoin(Breps=trim_2)  # -> Breps, Closed

# ---- group: Open Brow / Paired Loft
pairs_3 = Pairs(list=filter_2)  # -> A, B
merge = Merge(Data1=pairs_3.A, Data2=pairs_3.B)
loft = Loft(Curves=merge, Options=loft_options_2)
trim_3 = TrimTree(Tree=loft, Depth=1)
join_3 = BrepJoin(Breps=trim_3)  # -> Breps, Closed

# ---- group: Open Brow / Continuous Loft
loft_2 = Loft(Curves=filter_2, Options=loft_options_2)

# ---- group: Open Brow / Bifercated Sweep2
pairs_4 = Pairs(list=filter_2)  # -> A, B
deplane = DeconstructPlane(Plane=local_plane_2)  # -> Origin, XAxis, YAxis, ZAxis
merge_2 = Merge(Data1=pairs_4.A, Data2=pairs_4.B)
pl = ConstructPlane(Origin=deplane.Origin, XAxis=deplane.YAxis, YAxis=deplane.ZAxis)
planesrf = PlaneSurface(Plane=pl, XSize=Domain(-200, 200), YSize=Domain(-200, 200))

# ----
group = Group(Objects=merge_2)
trim_4 = TrimTree(Tree=group, Depth=1)
long = LongestList(ListA=trim_4, ListB=planesrf, PaddingMode=2)  # -> ListA, ListB
ungroup = Ungroup(Group=long.ListA)

# ---- group: Open Brow / Bifercated Sweep2 (continued)
split = SplitWithBrep(Curve=ungroup, Brep=graft(long.ListB))  # -> Curve, Points
item_2 = ListItem(List=split.Curve, Index=0, Wrap=True)  # -> Item, Item1
flip_3 = FlipCurve(Curve=item_2.Item)  # -> Curve, Flag
trim_5 = TrimTree(Tree=flip_3.Curve, Depth=1)
trim_6 = TrimTree(Tree=item_2.Item1, Depth=1)
item_3 = ListItem(List=trim_5, Index=0, Wrap=True)  # -> Item, Item1
item_4 = ListItem(List=trim_6, Index=0, Wrap=True)  # -> Item, Item1
end = EndPoints(Curve=trim_5)  # -> Start, End
end_2 = EndPoints(Curve=trim_6)  # -> Start, End
pline_2 = PolyLine(Vertices=end_2.Start, Closed=False)
pline_3 = PolyLine(Vertices=end.Start, Closed=False)
swp2_3 = Sweep2(Rail1=item_3.Item, Rail2=item_3.Item1, Sections=pline_3, SameHeight=False)
swp2_4 = Sweep2(Rail1=item_4.Item, Rail2=item_4.Item1, Sections=pline_2, SameHeight=False)
trim_7 = TrimTree(Tree=[swp2_3, swp2_4], Depth=2)
join_4 = BrepJoin(Breps=trim_7)  # -> Breps, Closed

# ---- group: Open Brow (continued)
filter_3 = StreamFilter(
    Gate=construction_type_2,
    Stream0=loft_2,
    Stream1=join_3.Breps,
    Stream2=join_2.Breps,
    Stream3=join.Breps,
    Stream4=join_4.Breps)
brow = Data(filter_3)

# ----
brow_2 = ClusterOutput(brow)

# ==== cluster Pairs
list = ClusterInput()

# ---- group: Listed Pairs
lng = ListLength(List=list)
series = Series(Start=0, Step=1, Count=expr("x-1", lng))
dom = ConstructDomain(DomainStart=series, DomainEnd=expr("x+1", series))
item = ListItem(List=list, Index=0, Wrap=True)
flip = FlipCurve(Curve=list, Guide=item)  # -> Curve, Flag
subset = SubList(List=flip.Curve, Domain=dom, Wrap=True)  # -> List, Index
item_2 = ListItem(List=subset.List, Index=0, Wrap=True)  # -> Item, Item1

# ----
A = ClusterOutput(item_2.Item)
B = ClusterOutput(item_2.Item1)
