# Grasshopper definition cncProfiler-v0.6.ghx (Grasshopper 1.0.8)
# Copyright: 2025
# plug-ins: MillerMoth Info

tool_diameter = Slider(0.5, range=0..4)
max_bridge_spacing = Slider(12, range=0..24)
total_cut_depth = Slider(0.75, range=0..4)
cut_stepdown = Slider(0.25, range=0..4)
bidge_height = Slider(0.15, range=0..1)
bridge_width = Slider(0.25, range=0..1)
spindal_speed = Slider(5000, range=5000..25000)
safe_z_height = Slider(2, range=0..50)
feed_rate = Slider(50, range=0..50)
inside_tabs = BooleanToggle(True)
center_tabs = BooleanToggle(False)
outside_tabs = BooleanToggle(False)
path = FilePath("/Users/cameron/Library/CloudStorage/GoogleDrive-cameronbehning@gmail.com/My Drive/CNC Profiler/ test.dwg")
data = Data(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)
tool_diameter_2 = GetNumber(tool_diameter, AtLeast=1, AtMost=1, Maximum=1.797693135e+308, Minimum=-1.797693135e+308, TreeAccess=False)
bridge_width_2 = GetNumber(bridge_width, AtLeast=1, AtMost=1, Maximum=1.797693135e+308, Minimum=-1.797693135e+308, TreeAccess=False)
max_bridge_spacing_2 = GetNumber(max_bridge_spacing, AtLeast=1, AtMost=1, Maximum=1.797693135e+308, Minimum=-1.797693135e+308, TreeAccess=False)
b64dxf = GetString(data, AtLeast=1, AtMost=1, TreeAccess=False)
total_cut_depth_2 = GetNumber(total_cut_depth, AtLeast=1, AtMost=1, Maximum=1.797693135e+308, Minimum=-1.797693135e+308, TreeAccess=False)
inside_tabs_2 = GetBoolean(inside_tabs, AtLeast=1, AtMost=1, FalseValue="False", TreeAccess=False, TrueValue="True")
center_tabs_2 = GetBoolean(center_tabs, AtLeast=1, AtMost=1, FalseValue="False", TreeAccess=False, TrueValue="True")
outside_tabs_2 = GetBoolean(outside_tabs, AtLeast=1, AtMost=1, FalseValue="False", TreeAccess=False, TrueValue="True")
cut_stepdown_2 = GetNumber(cut_stepdown, AtLeast=1, AtMost=1, Maximum=1.797693135e+308, Minimum=-1.797693135e+308, TreeAccess=False)
bidge_height_2 = GetNumber(bidge_height, AtLeast=1, AtMost=1, Maximum=1.797693135e+308, Minimum=-1.797693135e+308, TreeAccess=False)
spindal_rpm = GetNumber(spindal_speed, AtLeast=1, AtMost=1, Maximum=1.797693135e+308, Minimum=5000, TreeAccess=False)
safe_z_height_2 = GetNumber(safe_z_height, AtLeast=1, AtMost=1, Maximum=1.797693135e+308, Minimum=-1.797693135e+308, TreeAccess=False)
feed_rate_2 = GetNumber(feed_rate, AtLeast=1, AtMost=1, Maximum=1.797693135e+308, Minimum=-1.797693135e+308, TreeAccess=False)
py3 = Python3Script(Base64DXF=b64dxf)  # -> out, Geometry, Layers; inputs Base64DXF: String
# ---------- py3: Python ----------
import Rhino
import Rhino.Geometry as RG
import System
import System.IO
import clr

# 1. Import Grasshopper Types for Wrapping
clr.AddReference("Grasshopper")
from Grasshopper import DataTree
from Grasshopper.Kernel.Data import GH_Path
from Grasshopper.Kernel.Types import GH_Curve, GH_Point, GH_Brep, GH_Mesh, GH_Surface

def dxf_to_tree_and_list(b64_string):
    log = []
    
    # Initialize outputs
    tree = DataTree[System.Object]()
    layer_names_list = []
    layer_map = {} 

    if not b64_string:
        return tree, layer_names_list, ["Log: Input is empty"]

    temp_path = ""
    try:
        # --- Decode & Save ---
        if "," in b64_string:
            b64_string = b64_string.split(",")[1]
        
        file_bytes = System.Convert.FromBase64String(b64_string)
        temp_folder = System.IO.Path.GetTempPath()
        temp_file = System.Guid.NewGuid().ToString() + ".dxf"
        temp_path = System.IO.Path.Combine(temp_folder, temp_file)
        System.IO.File.WriteAllBytes(temp_path, file_bytes)
        log.append("Log: Saved temp DXF to " + temp_path)

        # --- Headless Import ---
        doc = Rhino.RhinoDoc.CreateHeadless(None)
        if not doc:
            return tree, layer_names_list, log + ["Log: Failed to create Headless Doc"]

        try:
            if not doc.Import(temp_path):
                return tree, layer_names_list, log + ["Log: DXF Import failed"]

            log.append("Log: Imported {} objects.".format(doc.Objects.Count))

            # --- Process Objects ---
            for obj in doc.Objects:
                try:
                    # 1. Get Geometry
                    geo = obj.Geometry.Duplicate()
                    
                    if not geo or not geo.IsValid:
                        continue

                    # 2. Get Layer Name
                    idx = obj.Attributes.LayerIndex
                    layer_name = "Default"
                    if idx >= 0 and idx < len(doc.Layers):
                        layer_name = doc.Layers[idx].Name
                    
                    # 3. Manage Tree Paths
                    if layer_name not in layer_map:
                        new_index = len(layer_names_list)
                        layer_map[layer_name] = new_index
                        layer_names_list.append(layer_name)
                    
                    branch_index = layer_map[layer_name]
                    path = GH_Path(branch_index)
                    
                    # 4. WRAP THE GEOMETRY (The Fix!) 🛡️
                    # This ensures MillerMoth sees a 'Curve', not a generic object
                    wrapped_geo = None
                    
                    if isinstance(geo, RG.Curve):
                        wrapped_geo = GH_Curve(geo)
                    elif isinstance(geo, RG.Brep):
                        wrapped_geo = GH_Brep(geo)
                    elif isinstance(geo, RG.Mesh):
                        wrapped_geo = GH_Mesh(geo)
                    elif isinstance(geo, RG.Point):
                        wrapped_geo = GH_Point(geo)
                    
                    # Only add if we successfully wrapped it
                    if wrapped_geo:
                        tree.Add(wrapped_geo, path)
                    
                except Exception as inner_e:
                    log.append("Log: Obj Error: " + str(inner_e))
                    continue

        finally:
            doc.Dispose()

    except Exception as e:
        log.append("Log: Critical Error: " + str(e))
        
    finally:
        if temp_path and System.IO.File.Exists(temp_path):
             try: System.IO.File.Delete(temp_path)
             except: pass

    return tree, layer_names_list, log

# --- EXECUTION ---
if Base64DXF:
    geo_tree, names, lines = dxf_to_tree_and_list(Base64DXF)
    
    Geometry = geo_tree
    Layers = names
    Log = lines
    
    if len(lines) > 0: print("\n".join(lines))
else:
    print("Waiting for input...")
# ---------- end py3 ----------
wrapper_for_active_doc = Python3Script(CurveIn=py3.Geometry)  # -> out, Log, CurveOut
# ---------- wrapper_for_active_doc: Python ----------
import Rhino
import System.IO
import scriptcontext as sc

# Initialize Log
log = []

def SetupHeadlessEnvironment():
    # 1. Check if the environment is already safe
    # If ActiveDoc exists, we assume we (or another component) already fixed it.
    if Rhino.RhinoDoc.ActiveDoc is not None:
        return

    # 2. Create the Bootstrap Template (Units + View)
    # We create a temporary 3dm file with all the correct settings "baked in"
    temp_folder = System.IO.Path.GetTempPath()
    temp_3dm_path = System.IO.Path.Combine(temp_folder, System.Guid.NewGuid().ToString() + "_env.3dm")
    
    f3dm = Rhino.FileIO.File3dm()
    
    # Set Units & Tolerances (Crucial for CAM math)
    settings = f3dm.Settings
    settings.ModelUnitSystem = Rhino.UnitSystem.Inches
    settings.ModelAbsoluteTolerance = 0.001
    settings.ModelAngleToleranceRadians = 0.01745 # ~1 degree
    settings.ModelRelativeTolerance = 0.01
    
    # Create Standard "Top" View (Crucial for Projection)
    view_info = Rhino.DocObjects.ViewInfo()
    view_info.Name = "Top"
    vp = view_info.Viewport
    vp.SetCameraLocation(Rhino.Geometry.Point3d(0, 0, 100))
    vp.SetCameraDirection(Rhino.Geometry.Vector3d(0, 0, -1))
    vp.SetCameraUp(Rhino.Geometry.Vector3d(0, 1, 0))
    vp.ChangeToParallelProjection(True)
    f3dm.Views.Add(view_info)
    
    # Save Template
    f3dm.Write(temp_3dm_path, Rhino.FileIO.File3dmWriteOptions())
    
    # 3. Open the Headless Doc
    # We DO NOT use 'using' or Dispose(). We need this to survive for the next component!
    doc = Rhino.RhinoDoc.CreateHeadless(temp_3dm_path)
    
    # 4. Force Global ActiveDoc
    Rhino.RhinoDoc.ActiveDoc = doc
    log.append("Log: Environment Created & ActiveDoc Set")
    
    # 5. Force ActiveView
    top_view = doc.Views.Find("Top", False)
    if top_view:
        doc.Views.ActiveView = top_view
        log.append("Log: ActiveView Set to 'Top'")
    else:
        log.append("Log: Warning - Top View not found")

# --- Execution ---
try:
    SetupHeadlessEnvironment()
    
    # Pass the geometry through to MillerMoth
    if CurveIn:
        CurveOut = CurveIn
        # Optional: Add the curve to the doc so it's "real"
        # Rhino.RhinoDoc.ActiveDoc.Objects.AddCurve(CurveIn) 
    else:
        log.append("Log: Waiting for Curve Input...")
    
except Exception as e:
    log.append("Error: " + str(e))

Log = log
# ---------- end wrapper_for_active_doc ----------
flatten = FlattenTree(Tree=py3.Geometry, Path="{0}")
flatten_2 = FlattenTree(Tree=wrapper_for_active_doc.CurveOut, Path="{0}")

lng = ListLength(List=py3.Layers)
series = Series(Start=0, Step=1, Count=lng)

get_curves_by_layer = GetCurvesByLayer(T=py3.Layers, T_2=wrapper_for_active_doc.CurveOut, P="*inside", L=series)
get_curves_by_layer_2 = GetCurvesByLayer(T=py3.Layers, T_2=wrapper_for_active_doc.CurveOut, P="*Center", L=series)
get_curves_by_layer_3 = GetCurvesByLayer(T=py3.Layers, T_2=wrapper_for_active_doc.CurveOut, P="*outside", L=series)
validation_redout = ValidationRedout(I=get_curves_by_layer, A="There are ", C=" inside curves", _1="No Inside Curves")
validation_redout_2 = ValidationRedout(I=get_curves_by_layer, A="There are ", C=" center curves", _1="No Inside Curves")
validation_redout_3 = ValidationRedout(I=get_curves_by_layer, A="There are ", C=" outside curves", _1="No Inside Curves")
cut_path_and_tabs = CutPathAndTabs_2(
    C=get_curves_by_layer_3,
    G=outside_tabs_2,
    td=tool_diameter_2,
    O="2",
    cd=total_cut_depth_2,
    sd=cut_stepdown_2,
    B=max_bridge_spacing_2,
    D=bridge_width_2,
    H=bidge_height_2)  # -> s_0, R
cut_path_and_tabs_2 = CutPathAndTabs(
    C=get_curves_by_layer,
    G=inside_tabs_2,
    td=tool_diameter_2,
    O="0",
    cd=total_cut_depth_2,
    sd=cut_stepdown_2,
    B=max_bridge_spacing_2,
    D=bridge_width_2,
    H=bidge_height_2)  # -> s_1, R
cut_path_and_tabs_3 = CutPathAndTabs_2(
    C=get_curves_by_layer_2,
    G=center_tabs_2,
    td=tool_diameter_2,
    O="1",
    cd=total_cut_depth_2,
    sd=cut_stepdown_2,
    B=max_bridge_spacing_2,
    D=bridge_width_2,
    H=bidge_height_2)  # -> s_0, R
entwine = Entwine(Branch00=cut_path_and_tabs_2.s_1, Branch01=cut_path_and_tabs_3.s_0, Branch02=cut_path_and_tabs.s_0, FlattenInputs=True)
safeheighter = SafeheightInjector(Curves=entwine, SafeHeight=safe_z_height_2)  # -> Combined, Toolpaths
setmillinggcodestream = SetMillingGCodeStream(
    FeedRate=feed_rate_2,
    SpindleSpeed=spindal_rpm,
    SafeHeight=safe_z_height_2,
    CoordinateMode=0,
    IncludeHoming=True,
    Plane=0,
    Units=1)
gengcode = GenerateGCode(GCodeStream=setmillinggcodestream, Toolpaths=flatten(safeheighter.Combined))  # -> UpdatedStream, GCode
validation_redout_4 = ValidationRedout_2(
    I=safeheighter.Combined,
    A="Safe Height Injected onto ",
    C=" curves. This should repeat 3 times",
    _1="No Safe Height Injected for these curves")  # -> flatten(stream)
gcv = GCodeVisualizer(
    GCode=gengcode.GCode,
    RapidMovementColor=RGB(4, 50, 255),
    CuttingMovementColor=RGB(255, 38, 0),
    CircularMovementColor=RGB(0, 142, 0),
    ScalingFactor=1,
    Offset=Point(0, 0, 0))  # -> VisualizedToolpaths, Legend
entwine_2 = Entwine(
    Branch00=py3.out,
    Branch01=wrapper_for_active_doc.Log,
    Branch02=validation_redout,
    Branch03=validation_redout_2,
    Branch04=validation_redout_3,
    Branch05=validation_redout_4,
    FlattenInputs=True)  # -> flatten(Result)
c_bake = ContextBake(DxfLines=flatten_2)
c_bake_2 = ContextBake(Content=gcv.VisualizedToolpaths)
c_print = ContextPrint(GCode=gengcode.GCode)
c_bake_3 = ContextBake(Content=entwine_2)

# ==== cluster GetCurvesByLayer
T = ClusterInput()
P = ClusterInput()
tmatch = MatchText(Text=T, Pattern=P, Case=False)
L = ClusterInput()
sift = SiftPattern(List=L, SiftPattern=tmatch)  # -> Output0, Output1
clean = CleanTree(RemoveNulls=True, RemoveInvalid=True, RemoveEmpty=False, Tree=sift.Output1)
concat = Concatenate(FragmentA="{", FragmentB=clean, FragmentC="}")
T_2 = ClusterInput()
branch = TreeBranch(Tree=T_2, Path=concat, MaintainPaths=True)
tpo = ToolpathOptimizer(Curves=branch)
ot = ClusterOutput(tpo)

# ==== cluster CutPathAndTabs
H = ClusterInput()
D = ClusterInput()
C = ClusterInput()
td = ClusterInput()
O = ClusterInput()
cd = ClusterInput()
sd = ClusterInput()
silmilling = SilhouetteMilling(BoundaryCurve=C, ToolDiameter=td, OffsetOption=O, Tolerance=0.01, CutDepth=cd, Stepdown=sd, CutMode=0, OffsetStyle=0)
data = Data(silmilling)
item = ListItem(List=reverse(data), Index=0, Wrap=True)
B = ClusterInput()
validation_redout = ValidationRedout(I=silmilling, A="There were ", C="  profile cut curves made from the input curve", _1="No Profile curves made")
len = Length(Curve=item)
validation_redout_2 = ValidationRedout(
    I=C,
    A="There were ",
    C="  profile cut curves successfully loaded into the cluster",
    _1="No curves loaded into the cluster")
division = Division(A=len, B=B)
round = Round(Number=division)  # -> Nearest, Floor, Ceiling
max = Maximum(A=round.Ceiling, B="3")
divide = DivideCurve(Curve=item, Count=max, Kinks=False)  # -> Points, Tangents, Parameters
c_script = CSharpScript(C=item, t=divide.Parameters, D=D)  # -> out, t_plus, t_minus; inputs C: Curve, t: Double, D: Double
# ---------- c_script: C# ----------
// Grasshopper Script Instance
#region Usings
using System;
using System.Linq;
using System.Collections;
using System.Collections.Generic;
using System.Drawing;

using Rhino;
using Rhino.Geometry;

using Grasshopper;
using Grasshopper.Kernel;
using Grasshopper.Kernel.Data;
using Grasshopper.Kernel.Types;
#endregion

public class Script_Instance : GH_ScriptInstance
{
    #region Notes
    /* 
      Members:
        RhinoDoc RhinoDocument
        GH_Document GrasshopperDocument
        IGH_Component Component
        int Iteration

      Methods (Virtual & overridable):
        Print(string text)
        Print(string format, params object[] args)
        Reflect(object obj)
        Reflect(object obj, string method_name)
    */
    #endregion

    // --- Start changing code here ---
  private void RunScript(
		Curve C,
		double t,
		double D,
		ref object t_plus,
		ref object t_minus)
  {
    // --- 1. VALIDATE INPUTS ---
    if (C == null)
    {
      Component.AddRuntimeMessage(GH_RuntimeMessageLevel.Error, "Input 'C' failed to collect data. Curve cannot be null.");
      return;
    }
    if (!C.IsValid)
    {
      Component.AddRuntimeMessage(GH_RuntimeMessageLevel.Error, "The provided curve is not valid.");
      return;
    }
    if (D < 0)
    {
        Component.AddRuntimeMessage(GH_RuntimeMessageLevel.Warning, "Distance 'D' is negative. Using its absolute value.");
        D = Math.Abs(D);
    }

    // --- 2. CORE LOGIC ---
    
    // It's good practice to ensure the input parameter 't' is within the curve's domain.
    // We clamp the value to be safe.
    double clamped_t = Math.Max(C.Domain.Min, Math.Min(C.Domain.Max, t));
    if (clamped_t != t)
    {
        Component.AddRuntimeMessage(GH_RuntimeMessageLevel.Warning, "Input parameter 't' was outside the curve's domain and has been clamped.");
    }

    // Calculate the length of the curve from its start point to the point at our parameter 't'.
    // We do this by creating a sub-domain of the curve and getting its length.
    Interval subDomain = new Interval(C.Domain.Min, clamped_t);
    double lengthAtT = C.GetLength(subDomain);

    // Calculate the target arc lengths by adding and subtracting the distance.
    double targetLengthPlus = lengthAtT + D;
    double targetLengthMinus = lengthAtT - D;

    // Now, convert these arc lengths back into curve parameters.
    // RhinoCommon's LengthParameter method handles this perfectly.
    // It automatically clamps the result to the start or end of the curve if the
    // target length is outside the possible range [0, TotalCurveLength].
    double out_t_plus, out_t_minus;
    
    C.LengthParameter(targetLengthPlus, out out_t_plus);
    C.LengthParameter(targetLengthMinus, out out_t_minus);
    
    // --- 3. ASSIGN OUTPUTS ---
    t_plus = out_t_plus;
    t_minus = out_t_minus;
  }
  // --- End changing code here ---
}
# ---------- end c_script ----------
c_script_2 = CSharpScript(C=item, t_minus=c_script.t_minus, t_plus=c_script.t_plus, H=H)  # -> out, MovedCurves; inputs C: Curve, t_minus: list of Double, t_plus: list of Double, H: Double
# ---------- c_script_2: C# ----------
// Grasshopper Script Instance
#region Usings
using System;
using System.Linq;
using System.Collections;
using System.Collections.Generic;
using System.Drawing;

using Rhino;
using Rhino.Geometry;

using Grasshopper;
using Grasshopper.Kernel;
using Grasshopper.Kernel.Data;
using Grasshopper.Kernel.Types;
#endregion

public class Script_Instance : GH_ScriptInstance
{
    #region Notes
    /* 
      Members:
        RhinoDoc RhinoDocument
        GH_Document GrasshopperDocument
        IGH_Component Component
        int Iteration

      Methods (Virtual & overridable):
        Print(string text)
        Print(string format, params object[] args)
        Reflect(object obj)
        Reflect(object obj, string method_name)
    */
    #endregion

    // --- Start changing code here ---
  private void RunScript(
		Curve C,
		List<double> t_minus,
		List<double> t_plus,
		double H,
		ref object MovedCurves)
  {
    // --- 1. VALIDATE INPUTS ---
    if (C == null)
    {
      Component.AddRuntimeMessage(GH_RuntimeMessageLevel.Error, "Input 'C' failed to collect data. Curve cannot be null.");
      return;
    }
    if (!C.IsValid)
    {
      Component.AddRuntimeMessage(GH_RuntimeMessageLevel.Error, "The provided curve is not valid.");
      return;
    }
    if (t_minus.Count != t_plus.Count)
    {
      Component.AddRuntimeMessage(GH_RuntimeMessageLevel.Error, "Input lists 't_minus' and 't_plus' must have the same number of items.");
      return;
    }

    // --- 2. PREPARE FOR SPLIT ---
    List<double> splitParams = new List<double>();
    splitParams.AddRange(t_minus);
    splitParams.AddRange(t_plus);
    
    double curveDomainMin = C.Domain.Min;
    double curveDomainMax = C.Domain.Max;

    // Sort and filter parameters to be strictly within the curve's domain.
    List<double> uniqueSortedParams = splitParams.Distinct().Where(p => p > curveDomainMin && p < curveDomainMax).ToList();
    uniqueSortedParams.Sort();

    // --- 3. SPLIT THE CURVE ---
    Curve[] splitSegments = C.Split(uniqueSortedParams);

    if (splitSegments == null || splitSegments.Length == 0)
    {
      Component.AddRuntimeMessage(GH_RuntimeMessageLevel.Warning, "Splitting the curve resulted in no segments.");
      MovedCurves = new List<Curve> { C };
      return;
    }

    // --- 4. PROCESS SEGMENTS (IDENTIFY, MOVE, AND STORE) ---
    List<Curve> processedSegments = new List<Curve>();
    Vector3d moveVector = new Vector3d(0, 0, H);

    foreach (Curve segment in splitSegments)
    {
      if (segment == null) continue;

      double midParam = (segment.Domain.Min + segment.Domain.Max) / 2.0;
      bool shouldMove = false;

      for (int i = 0; i < t_minus.Count; i++)
      {
        double start = Math.Min(t_minus[i], t_plus[i]);
        double end = Math.Max(t_minus[i], t_plus[i]);

        if (midParam > start && midParam < end)
        {
          shouldMove = true;
          break;
        }
      }

      if (shouldMove)
      {
        Curve movedSegment = segment.DuplicateCurve();
        movedSegment.Transform(Transform.Translation(moveVector));
        processedSegments.Add(movedSegment);
      }
      else
      {
        processedSegments.Add(segment);
      }
    }

    // --- 5. ADD CONNECTING LINES ---
    List<Curve> finalCurves = new List<Curve>();
    finalCurves.AddRange(processedSegments); // Add all the main segments first.

    // Iterate through the processed segments to find gaps to connect.
    for (int i = 0; i < processedSegments.Count - 1; i++)
    {
      Curve seg1 = processedSegments[i];
      Curve seg2 = processedSegments[i + 1];

      Point3d pt1_End = seg1.PointAtEnd;
      Point3d pt2_Start = seg2.PointAtStart;

      // If the end of one segment is not at the same location as the start of the next,
      // it means a translation occurred and we need to add a connector.
      if (pt1_End.DistanceTo(pt2_Start) > 1e-6) // Use a small tolerance
      {
        finalCurves.Add(new LineCurve(pt1_End, pt2_Start));
      }
    }

    // --- 6. ASSIGN OUTPUTS ---
    MovedCurves = finalCurves;
    Print("bridging added to the given line");
  }
  // --- End changing code here ---
}
# ---------- end c_script_2 ----------
merge = Merge(Data1=validation_redout_2, Data2=validation_redout, Data3=c_script_2.out)  # -> flatten(Result)
join = JoinCurves(Curves=c_script_2.MovedCurves, Preserve=False)
replace = ReplaceItems(List=reverse(data), Item=join, Indices="0", Wrap=False)  # -> reverse(List)
G = ClusterInput()
alicrvseams = AlignCurveSeams(Curves=replace, Snap=False, Iterative=True)  # -> Aligned, Points, R
filter = StreamFilter(Gate=G, Stream0=silmilling, Stream1=alicrvseams.Aligned)
s_1 = ClusterOutput(filter)
R = ClusterOutput(merge)

# ==== cluster CutPathAndTabs_2
H = ClusterInput()
D = ClusterInput()
C = ClusterInput()
td = ClusterInput()
O = ClusterInput()
cd = ClusterInput()
sd = ClusterInput()
silmilling = SilhouetteMilling(BoundaryCurve=C, ToolDiameter=td, OffsetOption=O, Tolerance=0.01, CutDepth=cd, Stepdown=sd, CutMode=0, OffsetStyle=0)
data = Data(silmilling)
item = ListItem(List=reverse(data), Index=0, Wrap=True)
B = ClusterInput()
validation_redout = ValidationRedout(I=silmilling, A="There were ", C="  profile cut curves made from the input curve", _1="No Profile curves made")
len = Length(Curve=item)
validation_redout_2 = ValidationRedout(
    I=C,
    A="There were ",
    C="  profile cut curves successfully loaded into the cluster",
    _1="No curves loaded into the cluster")
division = Division(A=len, B=B)
round = Round(Number=division)  # -> Nearest, Floor, Ceiling
max = Maximum(A=round.Ceiling, B="3")
divide = DivideCurve(Curve=item, Count=max, Kinks=False)  # -> Points, Tangents, Parameters
c_script = CSharpScript(C=item, t=divide.Parameters, D=D)  # -> out, t_plus, t_minus; inputs C: Curve, t: Double, D: Double; same code as c_script
c_script_2 = CSharpScript(C=item, t_minus=c_script.t_minus, t_plus=c_script.t_plus, H=H)  # -> out, MovedCurves; inputs C: Curve, t_minus: list of Double, t_plus: list of Double, H: Double; same code as c_script_2
merge = Merge(Data1=validation_redout_2, Data2=validation_redout, Data3=c_script_2.out)  # -> flatten(Result)
join = JoinCurves(Curves=c_script_2.MovedCurves, Preserve=False)
replace = ReplaceItems(List=reverse(data), Item=join, Indices="0", Wrap=False)  # -> reverse(List)
G = ClusterInput()
alicrvseams = AlignCurveSeams(Curves=replace, Snap=False, Iterative=True)  # -> Aligned, Points, R
filter = StreamFilter(Gate=G, Stream0=silmilling, Stream1=alicrvseams.Aligned)
s_0 = ClusterOutput(filter)
R = ClusterOutput(merge)

# ==== cluster ValidationRedout_2
I = ClusterInput()
A = ClusterInput()
C = ClusterInput()
null = NullItem(Item=I)  # -> NullFlags, InvalidFlags, Description
lng = ListLength(List=null.Description)
ma = MassAddition(Input=null.NullFlags)  # -> Result, PartialResults
_1 = ClusterInput()
concat = Concatenate(FragmentA=A, FragmentB=lng, FragmentC=C)
filter = StreamFilter(Gate=ma.Result, Stream0=concat, Stream1=_1)
stream = ClusterOutput(filter)

# ==== cluster ValidationRedout
I = ClusterInput()
A = ClusterInput()
C = ClusterInput()
null = NullItem(Item=I)  # -> NullFlags, InvalidFlags, Description
lng = ListLength(List=null.Description)
ma = MassAddition(Input=null.NullFlags)  # -> Result, PartialResults
_1 = ClusterInput()
concat = Concatenate(FragmentA=A, FragmentB=lng, FragmentC=C)
filter = StreamFilter(Gate=ma.Result, Stream0=concat, Stream1=_1)
s_0 = ClusterOutput(filter)
