# Grasshopper definition cncProfiler.gh (Grasshopper 1.0.8)
# Copyright: 2025
# plug-ins: MillerMoth Info

tool_diameter = Slider(0.5, range=0..4)
max_bridge_spacing = Slider(12, range=0..24)
total_cut_depth = Slider(0.75, range=0..4)
cut_stepdown = Slider(0.25, range=0..4)
bidge_height = Slider(0.15, range=0..1)
bridge_width = Slider(0.25, range=0..1)
spindal_speed = Slider(50, range=0..50)
safe_z_height = Slider(2, range=0..50)
feed_rate = Slider(50, range=0..50)
inside_tabs = BooleanToggle(True)
center_tabs = BooleanToggle(False)
outside_tabs = BooleanToggle(False)
path = FilePath("/Users/cameron/Library/CloudStorage/GoogleDrive-cameronbehning@gmail.com/My Drive/CNC Profiler/ test.dwg")
tool_diameter_2 = GetNumber(tool_diameter, AtLeast=1, AtMost=1, Maximum=1.797693135e+308, Minimum=-1.797693135e+308, TreeAccess=False)
bridge_width_2 = GetNumber(bridge_width, AtLeast=1, AtMost=1, Maximum=1.797693135e+308, Minimum=-1.797693135e+308, TreeAccess=False)
max_bridge_spacing_2 = GetNumber(max_bridge_spacing, AtLeast=1, AtMost=1, Maximum=1.797693135e+308, Minimum=-1.797693135e+308, TreeAccess=False)
b64dxf = GetString("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", AtLeast=1, AtMost=1, TreeAccess=False)
total_cut_depth_2 = GetNumber(total_cut_depth, AtLeast=1, AtMost=1, Maximum=1.797693135e+308, Minimum=-1.797693135e+308, TreeAccess=False)
inside_tabs_2 = GetBoolean(inside_tabs, AtLeast=1, AtMost=1, FalseValue="False", TreeAccess=False, TrueValue="True")
center_tabs_2 = GetBoolean(center_tabs, AtLeast=1, AtMost=1, FalseValue="False", TreeAccess=False, TrueValue="True")
outside_tabs_2 = GetBoolean(outside_tabs, AtLeast=1, AtMost=1, FalseValue="False", TreeAccess=False, TrueValue="True")
cut_stepdown_2 = GetNumber(cut_stepdown, AtLeast=1, AtMost=1, Maximum=1.797693135e+308, Minimum=-1.797693135e+308, TreeAccess=False)
bidge_height_2 = GetNumber(bidge_height, AtLeast=1, AtMost=1, Maximum=1.797693135e+308, Minimum=-1.797693135e+308, TreeAccess=False)
spindal_speed_2 = GetBoolean(spindal_speed, AtLeast=1, AtMost=1, FalseValue="False", TreeAccess=False, TrueValue="True")
safe_z_height_2 = GetBoolean(safe_z_height, AtLeast=1, AtMost=1, FalseValue="False", TreeAccess=False, TrueValue="True")
feed_rate_2 = GetBoolean(feed_rate, AtLeast=1, AtMost=1, FalseValue="False", TreeAccess=False, TrueValue="True")
py3 = Python3Script(b64=b64dxf)  # -> out, path
# ---------- py3: Python ----------
import System
import System.IO
import base64
import tempfile

path = None

if b64:
    try:
        # 1. Generate a Unique Filename (UUID)
        # This ensures that if 10 people upload at once, they don't overwrite each other.
        unique_name = str(System.Guid.NewGuid()) + ".dxf"
        
        # 2. Build the full path
        temp_dir = tempfile.gettempdir()
        temp_file = System.IO.Path.Combine(temp_dir, unique_name)

        # 3. Decode the Base64 string
        file_bytes = base64.b64decode(b64)

        # 4. Write the file to disk
        System.IO.File.WriteAllBytes(temp_file, file_bytes)

        # 5. Output the path for the next component
        path = temp_file
        
    except Exception as e:
        print("Error saving file:", e)
# ---------- end py3 ----------
b64_to_rhino_objects = Python3Script(b64=b64dxf)  # -> out, geo; inputs b64: String
# ---------- b64_to_rhino_objects: Python ----------
import Rhino
import System
import System.IO
import base64
import tempfile

geo = [] # Output list

if b64:
    # 1. Create a temporary file path
    # We use the system's temp folder so we don't clutter the server
    temp_dir = tempfile.gettempdir()
    temp_file = System.IO.Path.Combine(temp_dir, "upload_geometry.dxf")

    try:
        # 2. Decode the Base64 string back into raw bytes
        file_bytes = base64.b64decode(b64)

        # 3. Write the bytes to the temp file
        System.IO.File.WriteAllBytes(temp_file, file_bytes)

        # 4. Create a "Headless" Doc (No UI) to do the work safely
        headless_doc = Rhino.RhinoDoc.CreateHeadless(None)
        
        # 5. Import the file into that invisible doc
        # Note: We use the active doc's units to avoid scaling issues
        headless_doc.Import(temp_file)

        # 6. Extract the geometry
        for obj in headless_doc.Objects:
            geo.append(obj.Geometry.Duplicate())

        # 7. Cleanup the Headless Doc
        headless_doc.Dispose()

    except Exception as e:
        print("Error importing DXF:", e)

    finally:
        # 8. Always delete the temp file, even if the import crashed
        if System.IO.File.Exists(temp_file):
            try:
                System.IO.File.Delete(temp_file)
            except:
                pass
# ---------- end b64_to_rhino_objects ----------
import = ImportContent(FilePath=py3.path, Import=Toggle(True))  # -> ModelTransform, Objects, Layers, Linetypes, HatchPatterns, AnnotationStyles, Materials, BlockDefinitions
group = GroupContent(Content=import.Objects)  # -> Content, Values

lng = ListLength(List=group.Values)
series = Series(Start=0, Step=1, Count=lng)
pshift = ShiftPaths(Data=group.Content, Offset=Slider(2, range=0..10))

get_curves_by_layer = GetCurvesByLayer(T=group.Values, T_2=pshift, P="*inside", L=series)
get_curves_by_layer_2 = GetCurvesByLayer(T=group.Values, T_2=pshift, P="*Center", L=series)
get_curves_by_layer_3 = GetCurvesByLayer(T=group.Values, T_2=pshift, P="*outside", L=series)
cut_path_and_tabs = CutPathAndTabs_2(
    C=get_curves_by_layer_3,
    G=outside_tabs_2,
    td=tool_diameter_2,
    O="2",
    cd=total_cut_depth_2,
    sd=cut_stepdown_2,
    B=max_bridge_spacing_2,
    D=bridge_width_2,
    H=bidge_height_2)
cut_path_and_tabs_2 = CutPathAndTabs(
    C=get_curves_by_layer,
    G=inside_tabs_2,
    td=tool_diameter_2,
    O="0",
    cd=total_cut_depth_2,
    sd=cut_stepdown_2,
    B=max_bridge_spacing_2,
    D=bridge_width_2,
    H=bidge_height_2)
cut_path_and_tabs_3 = CutPathAndTabs_2(
    C=get_curves_by_layer_2,
    G=center_tabs_2,
    td=tool_diameter_2,
    O="1",
    cd=total_cut_depth_2,
    sd=cut_stepdown_2,
    B=max_bridge_spacing_2,
    D=bridge_width_2,
    H=bidge_height_2)
entwine = Entwine(Branch00=cut_path_and_tabs_2, Branch01=cut_path_and_tabs_3, Branch02=cut_path_and_tabs, FlattenInputs=True)
safeheighter = SafeheightInjector(Curves=entwine, SafeHeight=safe_z_height_2)  # -> Combined, Toolpaths
setmillinggcodestream = SetMillingGCodeStream(
    FeedRate=feed_rate_2,
    SpindleSpeed=spindal_speed_2,
    SafeHeight=safe_z_height_2,
    CoordinateMode=0,
    IncludeHoming=True,
    Plane=0,
    Units=1)
gengcode = GenerateGCode(GCodeStream=setmillinggcodestream, Toolpaths=flatten(safeheighter.Combined))  # -> UpdatedStream, GCode
gcv = GCodeVisualizer(
    GCode=gengcode.GCode,
    RapidMovementColor=RGB(4, 50, 255),
    CuttingMovementColor=RGB(255, 38, 0),
    CircularMovementColor=RGB(0, 142, 0),
    ScalingFactor=1,
    Offset=Point(0, 0, 0))  # -> VisualizedToolpaths, Legend
c_bake = ContextBake(DxfLines=import.Objects)
c_bake_2 = ContextBake(Content=gcv.VisualizedToolpaths)
c_print = ContextPrint(GCode=gengcode.GCode)

# ==== cluster GetCurvesByLayer
T = ClusterInput()
P = ClusterInput()
tmatch = MatchText(Text=T, Pattern=P, Case=False)
L = ClusterInput()
sift = SiftPattern(List=L, SiftPattern=tmatch)  # -> Output0, Output1
clean = CleanTree(RemoveNulls=True, RemoveInvalid=True, RemoveEmpty=False, Tree=sift.Output1)
concat = Concatenate(FragmentA="{0;", FragmentB=clean, FragmentC="}")
T_2 = ClusterInput()
branch = TreeBranch(Tree=T_2, Path=concat, MaintainPaths=True)
tpo = ToolpathOptimizer(Curves=branch)
ot = ClusterOutput(tpo)

# ==== cluster CutPathAndTabs
H = ClusterInput()
D = ClusterInput()
C = ClusterInput()
td = ClusterInput()
O = ClusterInput()
cd = ClusterInput()
sd = ClusterInput()
silmilling = SilhouetteMilling(BoundaryCurve=C, ToolDiameter=td, OffsetOption=O, Tolerance=0.01, CutDepth=cd, Stepdown=sd, CutMode=0, OffsetStyle=0)
data = Data(silmilling)
item = ListItem(List=reverse(data), Index=0, Wrap=True)
B = ClusterInput()
len = Length(Curve=item)
division = Division(A=len, B=B)
round = Round(Number=division)  # -> Nearest, Floor, Ceiling
max = Maximum(A=round.Ceiling, B="3")
divide = DivideCurve(Curve=item, Count=max, Kinks=False)  # -> Points, Tangents, Parameters
c_script = CSharpScript(C=item, t=divide.Parameters, D=D)  # -> out, t_plus, t_minus; inputs C: Curve, t: Double, D: Double
# ---------- c_script: C# ----------
// Grasshopper Script Instance
#region Usings
using System;
using System.Linq;
using System.Collections;
using System.Collections.Generic;
using System.Drawing;

using Rhino;
using Rhino.Geometry;

using Grasshopper;
using Grasshopper.Kernel;
using Grasshopper.Kernel.Data;
using Grasshopper.Kernel.Types;
#endregion

public class Script_Instance : GH_ScriptInstance
{
    #region Notes
    /* 
      Members:
        RhinoDoc RhinoDocument
        GH_Document GrasshopperDocument
        IGH_Component Component
        int Iteration

      Methods (Virtual & overridable):
        Print(string text)
        Print(string format, params object[] args)
        Reflect(object obj)
        Reflect(object obj, string method_name)
    */
    #endregion

    // --- Start changing code here ---
  private void RunScript(
		Curve C,
		double t,
		double D,
		ref object t_plus,
		ref object t_minus)
  {
    // --- 1. VALIDATE INPUTS ---
    if (C == null)
    {
      Component.AddRuntimeMessage(GH_RuntimeMessageLevel.Error, "Input 'C' failed to collect data. Curve cannot be null.");
      return;
    }
    if (!C.IsValid)
    {
      Component.AddRuntimeMessage(GH_RuntimeMessageLevel.Error, "The provided curve is not valid.");
      return;
    }
    if (D < 0)
    {
        Component.AddRuntimeMessage(GH_RuntimeMessageLevel.Warning, "Distance 'D' is negative. Using its absolute value.");
        D = Math.Abs(D);
    }

    // --- 2. CORE LOGIC ---
    
    // It's good practice to ensure the input parameter 't' is within the curve's domain.
    // We clamp the value to be safe.
    double clamped_t = Math.Max(C.Domain.Min, Math.Min(C.Domain.Max, t));
    if (clamped_t != t)
    {
        Component.AddRuntimeMessage(GH_RuntimeMessageLevel.Warning, "Input parameter 't' was outside the curve's domain and has been clamped.");
    }

    // Calculate the length of the curve from its start point to the point at our parameter 't'.
    // We do this by creating a sub-domain of the curve and getting its length.
    Interval subDomain = new Interval(C.Domain.Min, clamped_t);
    double lengthAtT = C.GetLength(subDomain);

    // Calculate the target arc lengths by adding and subtracting the distance.
    double targetLengthPlus = lengthAtT + D;
    double targetLengthMinus = lengthAtT - D;

    // Now, convert these arc lengths back into curve parameters.
    // RhinoCommon's LengthParameter method handles this perfectly.
    // It automatically clamps the result to the start or end of the curve if the
    // target length is outside the possible range [0, TotalCurveLength].
    double out_t_plus, out_t_minus;
    
    C.LengthParameter(targetLengthPlus, out out_t_plus);
    C.LengthParameter(targetLengthMinus, out out_t_minus);
    
    // --- 3. ASSIGN OUTPUTS ---
    t_plus = out_t_plus;
    t_minus = out_t_minus;
  }
  // --- End changing code here ---
}
# ---------- end c_script ----------
c_script_2 = CSharpScript(C=item, t_minus=c_script.t_minus, t_plus=c_script.t_plus, H=H)  # -> out, MovedCurves; inputs C: Curve, t_minus: list of Double, t_plus: list of Double, H: Double
# ---------- c_script_2: C# ----------
// Grasshopper Script Instance
#region Usings
using System;
using System.Linq;
using System.Collections;
using System.Collections.Generic;
using System.Drawing;

using Rhino;
using Rhino.Geometry;

using Grasshopper;
using Grasshopper.Kernel;
using Grasshopper.Kernel.Data;
using Grasshopper.Kernel.Types;
#endregion

public class Script_Instance : GH_ScriptInstance
{
    #region Notes
    /* 
      Members:
        RhinoDoc RhinoDocument
        GH_Document GrasshopperDocument
        IGH_Component Component
        int Iteration

      Methods (Virtual & overridable):
        Print(string text)
        Print(string format, params object[] args)
        Reflect(object obj)
        Reflect(object obj, string method_name)
    */
    #endregion

    // --- Start changing code here ---
  private void RunScript(
		Curve C,
		List<double> t_minus,
		List<double> t_plus,
		double H,
		ref object MovedCurves)
  {
    // --- 1. VALIDATE INPUTS ---
    if (C == null)
    {
      Component.AddRuntimeMessage(GH_RuntimeMessageLevel.Error, "Input 'C' failed to collect data. Curve cannot be null.");
      return;
    }
    if (!C.IsValid)
    {
      Component.AddRuntimeMessage(GH_RuntimeMessageLevel.Error, "The provided curve is not valid.");
      return;
    }
    if (t_minus.Count != t_plus.Count)
    {
      Component.AddRuntimeMessage(GH_RuntimeMessageLevel.Error, "Input lists 't_minus' and 't_plus' must have the same number of items.");
      return;
    }

    // --- 2. PREPARE FOR SPLIT ---
    List<double> splitParams = new List<double>();
    splitParams.AddRange(t_minus);
    splitParams.AddRange(t_plus);
    
    double curveDomainMin = C.Domain.Min;
    double curveDomainMax = C.Domain.Max;

    // Sort and filter parameters to be strictly within the curve's domain.
    List<double> uniqueSortedParams = splitParams.Distinct().Where(p => p > curveDomainMin && p < curveDomainMax).ToList();
    uniqueSortedParams.Sort();

    // --- 3. SPLIT THE CURVE ---
    Curve[] splitSegments = C.Split(uniqueSortedParams);

    if (splitSegments == null || splitSegments.Length == 0)
    {
      Component.AddRuntimeMessage(GH_RuntimeMessageLevel.Warning, "Splitting the curve resulted in no segments.");
      MovedCurves = new List<Curve> { C };
      return;
    }

    // --- 4. PROCESS SEGMENTS (IDENTIFY, MOVE, AND STORE) ---
    List<Curve> processedSegments = new List<Curve>();
    Vector3d moveVector = new Vector3d(0, 0, H);

    foreach (Curve segment in splitSegments)
    {
      if (segment == null) continue;

      double midParam = (segment.Domain.Min + segment.Domain.Max) / 2.0;
      bool shouldMove = false;

      for (int i = 0; i < t_minus.Count; i++)
      {
        double start = Math.Min(t_minus[i], t_plus[i]);
        double end = Math.Max(t_minus[i], t_plus[i]);

        if (midParam > start && midParam < end)
        {
          shouldMove = true;
          break;
        }
      }

      if (shouldMove)
      {
        Curve movedSegment = segment.DuplicateCurve();
        movedSegment.Transform(Transform.Translation(moveVector));
        processedSegments.Add(movedSegment);
      }
      else
      {
        processedSegments.Add(segment);
      }
    }

    // --- 5. ADD CONNECTING LINES ---
    List<Curve> finalCurves = new List<Curve>();
    finalCurves.AddRange(processedSegments); // Add all the main segments first.

    // Iterate through the processed segments to find gaps to connect.
    for (int i = 0; i < processedSegments.Count - 1; i++)
    {
      Curve seg1 = processedSegments[i];
      Curve seg2 = processedSegments[i + 1];

      Point3d pt1_End = seg1.PointAtEnd;
      Point3d pt2_Start = seg2.PointAtStart;

      // If the end of one segment is not at the same location as the start of the next,
      // it means a translation occurred and we need to add a connector.
      if (pt1_End.DistanceTo(pt2_Start) > 1e-6) // Use a small tolerance
      {
        finalCurves.Add(new LineCurve(pt1_End, pt2_Start));
      }
    }

    // --- 6. ASSIGN OUTPUTS ---
    MovedCurves = finalCurves;
  }
  // --- End changing code here ---
}
# ---------- end c_script_2 ----------
join = JoinCurves(Curves=c_script_2.MovedCurves, Preserve=False)
replace = ReplaceItems(List=reverse(data), Item=join, Indices="0", Wrap=False)  # -> reverse(List)
G = ClusterInput()
alicrvseams = AlignCurveSeams(Curves=replace, Snap=False, Iterative=True)  # -> Aligned, Points, R
filter = StreamFilter(Gate=G, Stream0=silmilling, Stream1=alicrvseams.Aligned)
s_1 = ClusterOutput(filter)

# ==== cluster CutPathAndTabs_2
H = ClusterInput()
D = ClusterInput()
C = ClusterInput()
td = ClusterInput()
O = ClusterInput()
cd = ClusterInput()
sd = ClusterInput()
silmilling = SilhouetteMilling(BoundaryCurve=C, ToolDiameter=td, OffsetOption=O, Tolerance=0.01, CutDepth=cd, Stepdown=sd, CutMode=0, OffsetStyle=0)
data = Data(silmilling)
item = ListItem(List=reverse(data), Index=0, Wrap=True)
B = ClusterInput()
len = Length(Curve=item)
division = Division(A=len, B=B)
round = Round(Number=division)  # -> Nearest, Floor, Ceiling
max = Maximum(A=round.Ceiling, B="3")
divide = DivideCurve(Curve=item, Count=max, Kinks=False)  # -> Points, Tangents, Parameters
c_script = CSharpScript(C=item, t=divide.Parameters, D=D)  # -> out, t_plus, t_minus; inputs C: Curve, t: Double, D: Double; same code as c_script
c_script_2 = CSharpScript(C=item, t_minus=c_script.t_minus, t_plus=c_script.t_plus, H=H)  # -> out, MovedCurves; inputs C: Curve, t_minus: list of Double, t_plus: list of Double, H: Double; same code as c_script_2
join = JoinCurves(Curves=c_script_2.MovedCurves, Preserve=False)
replace = ReplaceItems(List=reverse(data), Item=join, Indices="0", Wrap=False)  # -> reverse(List)
G = ClusterInput()
alicrvseams = AlignCurveSeams(Curves=replace, Snap=False, Iterative=True)  # -> Aligned, Points, R
filter = StreamFilter(Gate=G, Stream0=silmilling, Stream1=alicrvseams.Aligned)
s_0 = ClusterOutput(filter)
