# Grasshopper definition cncProfiler-v0.10.1.ghx (Grasshopper 1.0.8)
# Copyright: 2025
# plug-ins: Miller_Moth

max_bridge_spacing = Slider(12, range=0..24)
total_cut_depth = Slider(0.75, range=0..4)
cut_stepdown = Slider(0.25, range=0..4)
bridge_height = Slider(0.15, range=0..1)
tool_diameter = Slider(0.25, range=0..4)
spindal_speed = Slider(10000, range=5000..25000)
bridge_width = Slider(0.25, range=0..1)
safe_z_height = Slider(2, range=0..50)
feed_rate = Slider(80, range=1..600)
through_cut = BooleanToggle(False)
outside_tabs = BooleanToggle(True)
path = FilePath("/Users/cameron/Library/CloudStorage/GoogleDrive-cameronbehning@gmail.com/My Drive/CNC Profiler/ test.dwg")
part_to_stock_x = ValueList({"Left": -1, "Middle": 0, "Right": 1}, selected="Right")
part_to_stock_z = ValueList({"Top": 1, "Center": 0, "Bottom": -1}, selected="Top")
center_tabs = BooleanToggle(False)
part_to_stock_y = ValueList({"Front": -1, "Middle": 0, "Back": 1}, selected="Back")
inside_tabs = BooleanToggle(False)
stock_x0 = ValueList({"Left": -1, "Middle": 0, "Right": 1}, selected="Middle")
stock_z0 = ValueList({"Top": 1, "Center": 0, "Bottom": -1}, selected="Bottom")
stock_y0 = ValueList({"Front": -1, "Middle": 0, "Back": 1}, selected="Front")
lamp = Data(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)
stock_thickness = Slider(1, range=0..4)
stock_length = Slider(96, range=0..96)
stock_width = Slider(24, range=0..48)
data = Data(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)
stock_x0_2 = GetInteger(stock_x0, AtLeast=1, AtMost=1, Maximum=2147483647, Minimum=-2147483648, TreeAccess=False)
stock_y0_2 = GetInteger(stock_y0, AtLeast=1, AtMost=1, Maximum=2147483647, Minimum=-2147483648, TreeAccess=False)
part_to_stock_x_2 = GetInteger(part_to_stock_x, AtLeast=1, AtMost=1, Maximum=2147483647, Minimum=-2147483648, TreeAccess=False)
part_to_stock_y_2 = GetInteger(part_to_stock_y, AtLeast=1, AtMost=1, Maximum=2147483647, Minimum=-2147483648, TreeAccess=False)
stock_z0_2 = GetInteger(stock_z0, AtLeast=1, AtMost=1, Maximum=2147483647, Minimum=-2147483648, TreeAccess=False)
part_to_stock_z_2 = GetInteger(part_to_stock_z, AtLeast=1, AtMost=1, Maximum=2147483647, Minimum=-2147483648, TreeAccess=False)
inside_bridging = GetBoolean(
    inside_tabs,
    AtLeast=1,
    AtMost=1,
    FalseValue="False",
    Prompt="If enabled, all inside cuts will have bridging",
    TreeAccess=False,
    TrueValue="True")
center_bridging = GetBoolean(
    center_tabs,
    AtLeast=1,
    AtMost=1,
    FalseValue="False",
    Prompt="If enabled, all center cuts will have bridging",
    TreeAccess=False,
    TrueValue="True")
outside_bridging = GetBoolean(
    outside_tabs,
    AtLeast=1,
    AtMost=1,
    FalseValue="False",
    Prompt="If enabled, all outside cuts will have bridging",
    TreeAccess=False,
    TrueValue="True")
stock_thickness_2 = GetNumber(stock_thickness, AtLeast=1, AtMost=1, Maximum=1.797693135e+308, Minimum=-1.797693135e+308, TreeAccess=False)
stock_length_2 = GetNumber(stock_length, AtLeast=1, AtMost=1, Maximum=1.797693135e+308, Minimum=-1.797693135e+308, TreeAccess=False)
stock_width_2 = GetNumber(stock_width, AtLeast=1, AtMost=1, Maximum=1.797693135e+308, Minimum=-1.797693135e+308, TreeAccess=False)
max_bridge_spacing_2 = GetNumber(
    max_bridge_spacing,
    AtLeast=1,
    AtMost=1,
    Maximum=36,
    Minimum=0,
    Prompt="Maximum distance along the cut between bridging points",
    TreeAccess=False)
through_cut_2 = GetBoolean(
    through_cut,
    AtLeast=1,
    AtMost=1,
    FalseValue="Bottom",
    Prompt="Adds an additional 0.005 to the final cut pass to ensure through cutting",
    TreeAccess=False,
    TrueValue="Top")
total_cut_depth_2 = GetNumber(
    total_cut_depth,
    AtLeast=1,
    AtMost=1,
    Maximum=8,
    Minimum=0,
    Prompt="Make sure to use calipers to set this number to at least 2 decimal places. ",
    TreeAccess=False)
cut_stepdown_2 = GetNumber(
    cut_stepdown,
    AtLeast=1,
    AtMost=1,
    Maximum=2,
    Minimum=0,
    Prompt="Depth of each cut pass, Typically max is 2 times the bit diameter. Perform Chip load calculation to determin true maximum",
    TreeAccess=False)
tool_diameter_2 = GetNumber(
    tool_diameter,
    {"1/4", "3/8", "1/2", "3/4"}, selected=[],
    AtLeast=1,
    AtMost=1,
    Maximum=3,
    Minimum=0,
    Prompt="Check the bit you purchased for the size",
    TreeAccess=False)
bridge_width_2 = GetNumber(
    bridge_width,
    AtLeast=1,
    AtMost=1,
    Maximum=1,
    Minimum=0.1,
    Prompt="Width of Bridging to keep part attached to stock",
    TreeAccess=False)
bridge_height_2 = GetNumber(
    bridge_height,
    AtLeast=1,
    AtMost=1,
    Maximum=8,
    Minimum=0.01,
    Prompt="Height of Bridging to keep parts attached to stock",
    TreeAccess=False)
spindal_rpm = GetInteger(
    spindal_speed,
    AtLeast=1,
    AtMost=1,
    Maximum=36000,
    Minimum=5000,
    Prompt="This is the spindle speed. Perform Chipload calulations to determin max value. ",
    TreeAccess=False)
safe_z_height_2 = GetNumber(
    safe_z_height,
    AtLeast=1,
    AtMost=1,
    Maximum=8,
    Minimum=0,
    Prompt="This is the Z height the tool returns to when moving between cut locations. If using bottom Z0, make sure your Z height is higher than your material.",
    TreeAccess=False)
feed_rate_2 = GetNumber(
    feed_rate,
    AtLeast=1,
    AtMost=1,
    Maximum=600,
    Minimum=1,
    Prompt="This is the speed in Inches per minute that CNC will move. Check you chip load to calculate max. ",
    TreeAccess=False)
b64dxf = GetString(data, AtLeast=1, AtMost=1, TreeAccess=False)
py3 = Python3Script(Base64DXF=b64dxf)  # -> out, Geometry, Layers; inputs Base64DXF: String
# ---------- py3: Python ----------
import Rhino
import Rhino.Geometry as RG
import System
import System.IO
import clr
import math

clr.AddReference("Grasshopper")
from Grasshopper import DataTree
from Grasshopper.Kernel.Data import GH_Path
from Grasshopper.Kernel.Types import GH_Curve, GH_Point, GH_Brep, GH_Mesh, GH_Surface

def dxf_to_tree_and_list(b64_string):
    log = []
    tree = DataTree[System.Object]()
    layer_names_list = []
    layer_map = {} 

    if not b64_string:
        return tree, layer_names_list, ["Log: Input is empty"]

    temp_path = ""
    try:
        if "," in b64_string:
            b64_string = b64_string.split(",")[1]
        
        file_bytes = System.Convert.FromBase64String(b64_string)
        temp_folder = System.IO.Path.GetTempPath()
        temp_file = System.Guid.NewGuid().ToString() + ".dxf"
        temp_path = System.IO.Path.Combine(temp_folder, temp_file)
        System.IO.File.WriteAllBytes(temp_path, file_bytes)
        log.append("Log: Saved temp DXF to " + temp_path)

        success = False
        try:
            doc = Rhino.RhinoDoc.CreateHeadless(None)
            if doc:
                try:
                    if doc.Import(temp_path):
                        success = True
                        log.append("Log: Imported {} objects via Headless Doc.".format(doc.Objects.Count))
                        for obj in doc.Objects:
                            try:
                                geo = obj.Geometry.Duplicate()
                                if not geo or not geo.IsValid:
                                    continue
                                idx = obj.Attributes.LayerIndex
                                layer_name = "Default"
                                if idx >= 0 and idx < len(doc.Layers):
                                    layer_name = doc.Layers[idx].Name
                                if layer_name not in layer_map:
                                    layer_map[layer_name] = len(layer_names_list)
                                    layer_names_list.append(layer_name)
                                path = GH_Path(layer_map[layer_name])
                                wrapped_geo = None
                                if isinstance(geo, RG.Curve):
                                    wrapped_geo = GH_Curve(geo)
                                elif isinstance(geo, RG.Brep):
                                    wrapped_geo = GH_Brep(geo)
                                elif isinstance(geo, RG.Mesh):
                                    wrapped_geo = GH_Mesh(geo)
                                elif isinstance(geo, RG.Point):
                                    wrapped_geo = GH_Point(geo)
                                if wrapped_geo:
                                    tree.Add(wrapped_geo, path)
                            except Exception as inner_e:
                                log.append("Log: Obj Error: " + str(inner_e))
                finally:
                    doc.Dispose()
        except Exception as e_doc:
            log.append("Log: Headless doc error: " + str(e_doc))

        if not success:
            log.append("Log: Using ezdxf fallback importer...")
            import sys, glob
            for p in glob.glob("/var/lib/rhino-compute/.rhinocode/**/site-packages", recursive=True):
                if p not in sys.path:
                    sys.path.insert(0, p)
            import ezdxf
            dxf_doc = ezdxf.readfile(temp_path)
            msp = dxf_doc.modelspace()
            count = 0
            for e in msp:
                try:
                    t = e.dxftype()
                    layer_name = str(e.dxf.layer) if hasattr(e.dxf, 'layer') else "Default"
                    c = None
                    if t == 'LINE':
                        c = RG.LineCurve(RG.Point3d(float(e.dxf.start.x), float(e.dxf.start.y), float(e.dxf.start.z)),
                                         RG.Point3d(float(e.dxf.end.x), float(e.dxf.end.y), float(e.dxf.end.z)))
                    elif t == 'POLYLINE' or t == 'LWPOLYLINE':
                        pts = []
                        if hasattr(e, 'vertices'):
                            for v in e.vertices:
                                loc = v.dxf.location
                                pts.append(RG.Point3d(float(loc.x), float(loc.y), float(loc.z)))
                        elif hasattr(e, 'get_points'):
                            for pt in e.get_points():
                                pts.append(RG.Point3d(float(pt[0]), float(pt[1]), float(pt[2]) if len(pt) > 2 else 0.0))
                        if getattr(e, 'is_closed', False) and len(pts) > 0 and (pts[0].DistanceTo(pts[-1]) > 1e-5):
                            pts.append(pts[0])
                        if len(pts) >= 2:
                            c = RG.PolylineCurve(pts)
                    elif t == 'CIRCLE':
                        center = RG.Point3d(float(e.dxf.center.x), float(e.dxf.center.y), float(e.dxf.center.z))
                        c = RG.ArcCurve(RG.Circle(center, float(e.dxf.radius)))
                    elif t == 'ARC':
                        center = RG.Point3d(float(e.dxf.center.x), float(e.dxf.center.y), float(e.dxf.center.z))
                        sa = math.radians(float(e.dxf.start_angle))
                        ea = math.radians(float(e.dxf.end_angle))
                        c = RG.ArcCurve(RG.Arc(RG.Circle(center, float(e.dxf.radius)), RG.Interval(sa, ea)))
                    elif t == 'SPLINE':
                        pts = [RG.Point3d(float(p[0]), float(p[1]), float(p[2]) if len(p) > 2 else 0.0) for p in e.flattening(0.01)]
                        if getattr(e, 'closed', False) and len(pts) > 0 and (pts[0].DistanceTo(pts[-1]) > 1e-5):
                            pts.append(pts[0])
                        if len(pts) >= 2:
                            c = RG.PolylineCurve(pts)
                    
                    if c and c.IsValid:
                        if layer_name not in layer_map:
                            layer_map[layer_name] = len(layer_names_list)
                            layer_names_list.append(layer_name)
                        path = GH_Path(layer_map[layer_name])
                        tree.Add(GH_Curve(c), path)
                        count += 1
                except Exception as inner_ez:
                    log.append("Log: ezdxf entity error: " + str(inner_ez))
            log.append("Log: ezdxf imported " + str(count) + " curves.")

    except Exception as e:
        log.append("Log: Critical Error: " + str(e))
        
    finally:
        if temp_path and System.IO.File.Exists(temp_path):
             try: System.IO.File.Delete(temp_path)
             except: pass

    return tree, layer_names_list, log

if Base64DXF:
    geo_tree, names, lines = dxf_to_tree_and_list(Base64DXF)
    Geometry = geo_tree
    Layers = names
    Log = lines
    for line in lines:
        print(line)
else:
    print("Waiting for input...")
# ---------- end py3 ----------

test = BooleanToggle(False)
layers = QueryModelLayers(AutoUpdateState=True)  # disabled
layer = ModelLayer(Layer=layers)  # -> Layer, Name; disabled
number_slider = Slider(2, range=0..100)  # disabled
m_objects = QueryModelObjects(Layer=layer.Name, Locked=True, Hidden=True, AutoUpdateState=True)  # disabled
pshift = ShiftPaths(Data=m_objects, Offset=number_slider)  # disabled
filter = StreamFilter(Gate=test, Stream0=py3.Geometry, Stream1=pshift)
filter_2 = StreamFilter(Gate=test, Stream0=py3.Layers, Stream1=layer.Name)

c_script = CSharpScript(sx=stock_width_2, sy=stock_length_2, sz=stock_thickness_2, ax=stock_x0_2, ay=stock_y0_2, az=stock_z0_2)  # -> out, A; inputs sx: Double, sy: Double, sz: Double, ax: Int32, ay: Int32, az: Int32
# ---------- c_script: C# ----------
// Grasshopper Script Instance
#region Usings
using System;
using System.Linq;
using System.Collections;
using System.Collections.Generic;
using System.Drawing;

using Rhino;
using Rhino.Geometry;

using Grasshopper;
using Grasshopper.Kernel;
using Grasshopper.Kernel.Data;
using Grasshopper.Kernel.Types;
#endregion

public class Script_Instance : GH_ScriptInstance
{
    #region Notes
    /* 
      Members:
        RhinoDoc RhinoDocument
        GH_Document GrasshopperDocument
        IGH_Component Component
        int Iteration

      Methods (Virtual & overridable):
        Print(string text)
        Print(string format, params object[] args)
        Reflect(object obj)
        Reflect(object obj, string method_name)
    */
    #endregion

    private void RunScript(
		double sx,
		double sy,
		double sz,
		int ax,
		int ay,
		int az,
		ref object A)
{
    // 1. Fallback for zero or negative inputs to prevent collapsed boxes
    if (sx <= 0) sx = 100.0;
    if (sy <= 0) sy = 100.0;
    if (sz <= 0) sz = 20.0;

    // 2. Clamp alignment inputs to ensure they are strictly -1, 0, or 1
    ax = Math.Max(-1, Math.Min(1, ax));
    ay = Math.Max(-1, Math.Min(1, ay));
    az = Math.Max(-1, Math.Min(1, az));

    // 3. Mathematical alignment trick:
    // If align = -1 (Left/Back/Bottom) -> min = 0, max = size
    // If align =  0 (Center)           -> min = -size/2, max = size/2
    // If align =  1 (Right/Front/Top)  -> min = -size, max = 0
    
    double minX = -(sx / 2.0) * (ax + 1);
    double maxX =  (sx / 2.0) * (1 - ax);

    double minY = -(sy / 2.0) * (ay + 1);
    double maxY =  (sy / 2.0) * (1 - ay);

    double minZ = -(sz / 2.0) * (az + 1);
    double maxZ =  (sz / 2.0) * (1 - az);

    // 4. Create geometric intervals
    Interval ix = new Interval(minX, maxX);
    Interval iy = new Interval(minY, maxY);
    Interval iz = new Interval(minZ, maxZ);

    // 5. Generate and output the Box
    Box stockBox = new Box(Plane.WorldXY, ix, iy, iz);
    
    A = stockBox;
}
}
# ---------- end c_script ----------
cut_through_depth = Panel("0.01")
filter_3 = StreamFilter(Gate=through_cut_2, Stream0="0", Stream1=cut_through_depth)

lng = ListLength(List=filter_2)
series = Series(Start=0, Step=1, Count=lng)

multiplication = Multiplication(A=Slider(0.5, range=0..1), B=feed_rate_2)
setmillinggcodestream = SetMillingGCodeStream(
    FeedRate=feed_rate_2,
    SpindleSpeed=spindal_rpm,
    SafeHeight=safe_z_height_2,
    InitialTool=null,
    PlungeFeed=multiplication,
    ArcFitting=True,
    ArcTolerance=0.05,
    EngagementModifier=False,
    WOCFraction=0.5,
    MinScaleSlot=0.4,
    EngagementExponent=1,
    ArcTol=0.01,
    CoordinateMode=0,
    EnableArcs=True,
    IncludeHoming=False,
    Plane=0,
    Units=1)
setmillinggcodestream_2 = SetMillingGCodeStream(
    FeedRate=500,
    SpindleSpeed=10000,
    SafeHeight=15,
    ArcFitting=False,
    ArcTolerance=0.05,
    EngagementModifier=False,
    WOCFraction=0.5,
    MinScaleSlot=0.4,
    EngagementExponent=1,
    ArcTol=0.05,
    CoordinateMode=0,
    EnableArcs=False,
    IncludeHoming=True,
    Plane=0,
    Units=0)
c_bake = ContextBake(Content=c_script.A)

# ---- group: Cleaning
xy = XYPlane(Origin=Point(0, 0, 0))
project = Project(Geometry=filter, Plane=xy)  # -> Geometry, Transform

# ----
c_script_2 = CSharpScript(G=flatten(project.Geometry), Stock=c_script.A, gx=part_to_stock_x_2, gy=part_to_stock_y_2, gz=part_to_stock_z_2)  # -> out, A; inputs G: list of GeometryBase, Stock: Box, gx: Int32, gy: Int32, gz: Int32
# ---------- c_script_2: C# ----------
// Grasshopper Script Instance
#region Usings
using System;
using System.Linq;
using System.Collections;
using System.Collections.Generic;
using System.Drawing;

using Rhino;
using Rhino.Geometry;

using Grasshopper;
using Grasshopper.Kernel;
using Grasshopper.Kernel.Data;
using Grasshopper.Kernel.Types;
#endregion

public class Script_Instance : GH_ScriptInstance
{
    #region Notes
    /* 
      Members:
        RhinoDoc RhinoDocument
        GH_Document GrasshopperDocument
        IGH_Component Component
        int Iteration

      Methods (Virtual & overridable):
        Print(string text)
        Print(string format, params object[] args)
        Reflect(object obj)
        Reflect(object obj, string method_name)
    */
    #endregion

    private void RunScript(
		List<GeometryBase> G,
		Box Stock,
		int gx,
		int gy,
		int gz,
		ref object A)
{
    // 1. Guard against empty inputs
    if (G == null || G.Count == 0 || !Stock.IsValid) return;

    // 2. Get the Bounding Box of the Stock
    BoundingBox stockBox = Stock.BoundingBox;

    // 3. Calculate the collective Bounding Box for ALL incoming geometry
    BoundingBox geoBox = BoundingBox.Empty;
    foreach (GeometryBase geom in G)
    {
        if (geom != null) geoBox.Union(geom.GetBoundingBox(true)); 
    }
    if (!geoBox.IsValid) return;

    // 4. Clamp alignment inputs to ensure they are strictly -1, 0, or 1
    gx = Math.Max(-1, Math.Min(1, gx));
    gy = Math.Max(-1, Math.Min(1, gy));
    gz = Math.Max(-1, Math.Min(1, gz));

    // 5. Helper function to find the anchor coordinate
    double GetAnchorCoord(double min, double max, int align)
    {
        if (align == -1) return min;       // Minimum Bound
        if (align == 1) return max;        // Maximum Bound
        return (min + max) / 2.0;          // Center
    }

    // 6. Find the target anchor point on the STOCK
    double targetX = GetAnchorCoord(stockBox.Min.X, stockBox.Max.X, gx);
    double targetY = GetAnchorCoord(stockBox.Min.Y, stockBox.Max.Y, gy);
    double targetZ = GetAnchorCoord(stockBox.Min.Z, stockBox.Max.Z, gz);

    // 7. Find the current anchor point on the GEOMETRY
    double currentX = GetAnchorCoord(geoBox.Min.X, geoBox.Max.X, gx);
    double currentY = GetAnchorCoord(geoBox.Min.Y, geoBox.Max.Y, gy);
    double currentZ = GetAnchorCoord(geoBox.Min.Z, geoBox.Max.Z, gz);

    // 8. Calculate the exact vector needed to move Geometry to the Stock
    Vector3d moveVector = new Vector3d(targetX - currentX, targetY - currentY, targetZ - currentZ);
    Transform moveXform = Transform.Translation(moveVector);

    // 9. Apply the transformation to a duplicate of the geometry
    List<GeometryBase> alignedGeometry = new List<GeometryBase>();
    foreach (GeometryBase geom in G)
    {
        if (geom != null)
        {
            GeometryBase dup = geom.Duplicate();
            dup.Transform(moveXform);
            alignedGeometry.Add(dup);
        }
    }

    // 10. Output the aligned geometry
    A = alignedGeometry;
}
}
# ---------- end c_script_2 ----------
unflatten = UnflattenTree(Tree=c_script_2.A, Guide=project.Geometry)

# ---- group: Cleaning (continued)
join = JoinCurves(Curves=unflatten, Preserve=False)
cls = Closed(Curve=join)  # -> Closed, Periodic
dispatch = Dispatch(List=join, DispatchPattern=cls.Closed)  # -> ListA, ListB
pshift_2 = ShiftPaths(Data=dispatch.ListB, Offset=-1)
pshift_3 = ShiftPaths(Data=dispatch.ListA, Offset=-1)

# ----
wrapper_for_active_doc = Python3Script(CurveIn=pshift_3)  # -> out, Log, CurveOut
# ---------- wrapper_for_active_doc: Python ----------
import Rhino
import System.IO
import scriptcontext as sc

# Initialize Log
log = []

def SetupHeadlessEnvironment():
    # 1. Check if the environment is already safe
    # If ActiveDoc exists, we assume we (or another component) already fixed it.
    if Rhino.RhinoDoc.ActiveDoc is not None:
        return

    # 2. Create the Bootstrap Template (Units + View)
    # We create a temporary 3dm file with all the correct settings "baked in"
    temp_folder = System.IO.Path.GetTempPath()
    temp_3dm_path = System.IO.Path.Combine(temp_folder, System.Guid.NewGuid().ToString() + "_env.3dm")
    
    f3dm = Rhino.FileIO.File3dm()
    
    # Set Units & Tolerances (Crucial for CAM math)
    settings = f3dm.Settings
    settings.ModelUnitSystem = Rhino.UnitSystem.Inches
    settings.ModelAbsoluteTolerance = 0.001
    settings.ModelAngleToleranceRadians = 0.01745 # ~1 degree
    settings.ModelRelativeTolerance = 0.001
    
    # Create Standard "Top" View (Crucial for Projection)
    view_info = Rhino.DocObjects.ViewInfo()
    view_info.Name = "Top"
    vp = view_info.Viewport
    vp.SetCameraLocation(Rhino.Geometry.Point3d(0, 0, 100))
    vp.SetCameraDirection(Rhino.Geometry.Vector3d(0, 0, -1))
    vp.SetCameraUp(Rhino.Geometry.Vector3d(0, 1, 0))
    vp.ChangeToParallelProjection(True)
    f3dm.Views.Add(view_info)
    
    # Save Template
    f3dm.Write(temp_3dm_path, Rhino.FileIO.File3dmWriteOptions())
    
    # 3. Open the Headless Doc
    # We DO NOT use 'using' or Dispose(). We need this to survive for the next component!
    doc = Rhino.RhinoDoc.CreateHeadless(temp_3dm_path)
    
    # 4. Force Global ActiveDoc
    Rhino.RhinoDoc.ActiveDoc = doc
    log.append("Log: Environment Created & ActiveDoc Set")
    
    # 5. Force ActiveView
    top_view = doc.Views.Find("Top", False)
    if top_view:
        doc.Views.ActiveView = top_view
        log.append("Log: ActiveView Set to 'Top'")
    else:
        log.append("Log: Warning - Top View not found")

# --- Execution ---
try:
    SetupHeadlessEnvironment()
    
    # Pass the geometry through to MillerMoth
    if CurveIn:
        CurveOut = CurveIn
        # Optional: Add the curve to the doc so it's "real"
        # Rhino.RhinoDoc.ActiveDoc.Objects.AddCurve(CurveIn) 
    else:
        log.append("Log: Waiting for Curve Input...")
    
except Exception as e:
    log.append("Error: " + str(e))

Log = log
# ---------- end wrapper_for_active_doc ----------
get_curves_by_layer = GetCurvesByLayer(T=filter_2, T_2=wrapper_for_active_doc.CurveOut, P="*inside", L=series)  # -> ot, branch_2
get_curves_by_layer_2 = GetCurvesByLayer(T=filter_2, T_2=wrapper_for_active_doc.CurveOut, P="*Center", L=series)  # -> ot, branch_2
get_curves_by_layer_3 = GetCurvesByLayer(T=filter_2, T_2=wrapper_for_active_doc.CurveOut, P="*outside", L=series)  # -> ot, branch_2
merge = Merge(Data1=get_curves_by_layer.branch_2, Data2=get_curves_by_layer_2.branch_2, Data3=get_curves_by_layer_3.branch_2)
py3_2 = Python3Script(Tree=wrapper_for_active_doc.CurveOut, Paths=merge)  # -> out, CleanTree; inputs Tree: tree, Paths: list of String
# ---------- py3_2: Python ----------
"""
Removes specific branches from a DataTree.
Inputs:
    Tree: The input DataTree (Set Tree Access)
    Paths: List of strings representing paths to remove (e.g. "{0;1}", "2")
Outputs:
    CleanTree: The resulting DataTree
"""

import Grasshopper
import Grasshopper.Kernel.Data as gh

def create_path_from_string(path_str):
    """
    Manually parses a path string like "{0;1}" or "2" 
    into a GH_Path object using integers to avoid constructor errors.
    """
    try:
        # 1. Remove curly braces and whitespace
        clean_str = path_str.replace("{", "").replace("}", "").strip()
        
        # 2. Split by semicolon (handles complex paths like 0;1;5)
        if ";" in clean_str:
            parts = clean_str.split(";")
        else:
            # Handle single dimension paths like "2"
            parts = [clean_str]
            
        # 3. Convert parts to integers
        path_ints = [int(x) for x in parts]
        
        # 4. Construct GH_Path using the integer list unpacking
        # This calls the GH_Path(int, int...) constructor which is safe
        return gh.GH_Path(*path_ints)
        
    except Exception as e:
        print(f"Warning: Failed to convert '{path_str}' to Path. {e}")
        return None

def remove_branches(input_tree, paths_to_remove):
    if paths_to_remove is None:
        return input_tree

    # --- Build Removal Set ---
    remove_set = set()
    
    for p in paths_to_remove:
        if p is None: 
            continue
            
        # Convert input to string (in case user inputs integers directly)
        p_str = str(p)
        if not p_str.strip():
            continue
            
        path_obj = create_path_from_string(p_str)
        if path_obj is not None:
            remove_set.add(path_obj)

    if not remove_set:
        return input_tree

    # --- Create New Tree ---
    new_tree = Grasshopper.DataTree[object]()
    
    # Handle Rhino 8 (BranchCount) vs Legacy (PathCount)
    if hasattr(input_tree, "BranchCount"):
        count = input_tree.BranchCount
        is_wrapper = True
    else:
        count = input_tree.PathCount
        is_wrapper = False

    for i in range(count):
        if is_wrapper:
            current_path = input_tree.Path(i)
            current_data = input_tree.Branch(i)
        else:
            current_path = input_tree.Paths[i]
            current_data = input_tree.Branch(current_path)

        # Check if current path exists in our remove set
        if current_path not in remove_set:
            new_tree.AddRange(current_data, current_path)

    return new_tree

# --- Execution ---
CleanTree = None

if Tree:
    CleanTree = remove_branches(Tree, Paths)
# ---------- end py3_2 ----------
cut_path_and_tabs = CutPathAndTabs(
    G=inside_bridging,
    C=get_curves_by_layer.ot,
    td=tool_diameter_2,
    O="0",
    cd=total_cut_depth_2,
    sd=cut_stepdown_2,
    cut_through_depth=filter_3,
    D=bridge_width_2,
    B_2=bridge_height_2,
    B=max_bridge_spacing_2)  # -> R, profile_curves
cut_path_and_tabs_2 = CutPathAndTabs(
    G=center_bridging,
    C=get_curves_by_layer_2.ot,
    td=tool_diameter_2,
    O="1",
    cd=total_cut_depth_2,
    sd=cut_stepdown_2,
    cut_through_depth=filter_3,
    D=bridge_width_2,
    B_2=bridge_height_2,
    B=max_bridge_spacing_2)  # -> R, profile_curves
cut_path_and_tabs_3 = CutPathAndTabs(
    G=outside_bridging,
    C=get_curves_by_layer_3.ot,
    td=tool_diameter_2,
    O="2",
    cd=total_cut_depth_2,
    sd=cut_stepdown_2,
    cut_through_depth=filter_3,
    D=bridge_width_2,
    B_2=bridge_height_2,
    B=max_bridge_spacing_2)  # -> R, profile_curves
validation_redout = ValidationRedout(I=get_curves_by_layer.ot, A="There are ", C=" inside curves", _1="No Inside Curves")
validation_redout_2 = ValidationRedout(I=get_curves_by_layer.ot, A="There are ", C=" center curves", _1="No Inside Curves")
validation_redout_3 = ValidationRedout(I=get_curves_by_layer.ot, A="There are ", C=" outside curves", _1="No Inside Curves")
entwine = Entwine(
    Branch00=cut_path_and_tabs.profile_curves,
    Branch01=cut_path_and_tabs_2.profile_curves,
    Branch02=cut_path_and_tabs_3.profile_curves,
    FlattenInputs=True)
lng_2 = ListLength(List=flatten(entwine))
safeheighter = SafeheightInjector(
    Curves=entwine,
    SafeHeight=safe_z_height_2,
    GCodeStream=setmillinggcodestream,
    gcode=False,
    lead=False,
    opt=False,
    sep=False,
    zsort=False)  # -> Combined, Toolpaths, UpdatedStream, GCode
larger = LargerThan(FirstNumber=lng_2, SecondNumber="0")  # -> LargerThan, OrEqualTo

validation_redout_4 = ValidationRedout_2(
    I=safeheighter.Combined,
    A="Safe Height Injected onto ",
    C=" curves. This should repeat 3 times",
    _1="No Safe Height Injected for these curves")  # -> flatten(stream)

gate = StreamGate(Stream=safeheighter.Combined, Gate=larger.LargerThan)  # -> Target0, Target1
gengcode = GenerateGCode(GCodeStream=setmillinggcodestream, Toolpaths=flatten(gate.Target1))  # -> UpdatedStream, GCode
panel = Panel(gengcode.GCode)

validation_redout_5 = ValidationRedout_2(
    I=safeheighter.Combined,
    A="Safe Height Injected onto ",
    C=" curves. This should repeat 3 times",
    _1="No Safe Height Injected for these curves")  # -> flatten(stream)

entwine_2 = Entwine(
    Branch00=py3.out,
    Branch01=wrapper_for_active_doc.Log,
    Branch02=validation_redout,
    Branch03=validation_redout_2,
    Branch04=validation_redout_3,
    Branch05=cut_path_and_tabs.R,
    Branch06=cut_path_and_tabs_2.R,
    Branch07=cut_path_and_tabs_3.R,
    Branch08=validation_redout_4,
    FlattenInputs=True)  # -> flatten(Result)
py3_3 = Python3Script(gcode_text=gengcode.GCode, script_name="cncProfiler v0.10.0")  # -> out, Polyline, ModifiedGcode, PointList; inputs gcode_text: String
# ---------- py3_3: Python ----------
"""
Parses G-code, cleans consecutive duplicate points, and generates geometry/stats.
Inputs:
    gcode_text: Raw G-code string
    script_name: Name for the header
Outputs:
    Polyline: The resulting curve
    ModifiedGcode: Text with stats header
    PointList: The CLEANED list of points
"""

import Rhino
import Rhino.Geometry as rg
import datetime

def process_gcode(raw_text, s_name):
    debug_log = []
    
    if not raw_text:
        return None, "Error: Input text is empty.", [], debug_log
    
    if not s_name:
        s_name = "Grasshopper Script"

    lines = raw_text.splitlines()
    original_line_count = len(lines)
    
    # --- 1. Parsing Logic ---
    raw_points = []
    
    current_x = 0.0
    current_y = 0.0
    current_z = 0.0
    
    # Stats
    x_vals = []
    y_vals = []
    z_vals = []
    f_vals = []
    s_vals = []
    
    for line in lines:
        clean_line = line.strip().upper()
        if ";" in clean_line:
            clean_line = clean_line.split(";")[0].strip()
        
        if not clean_line:
            continue

        parts = clean_line.split()
        
        # F/S Parsing
        for part in parts:
            try:
                if part.startswith("S"):
                    s_vals.append(float(part[1:]))
                elif part.startswith("F"):
                    f_vals.append(float(part[1:]))
            except:
                pass

        # G1 Parsing
        if clean_line.startswith("G1"):
            geometry_updated = False
            for part in parts:
                try:
                    if len(part) > 1:
                        if part.startswith("X"):
                            current_x = float(part[1:])
                            geometry_updated = True
                        elif part.startswith("Y"):
                            current_y = float(part[1:])
                            geometry_updated = True
                        elif part.startswith("Z"):
                            current_z = float(part[1:])
                            geometry_updated = True
                except ValueError:
                    continue
            
            if geometry_updated:
                pt = rg.Point3d(current_x, current_y, current_z)
                raw_points.append(pt)
                
                # Update bounds stats
                x_vals.append(current_x)
                y_vals.append(current_y)
                z_vals.append(current_z)

    # --- 2. Cleaning Duplicates ---
    clean_points = []
    if raw_points:
        # Always add the first point
        clean_points.append(raw_points[0])
        
        # Check subsequent points against the last added point
        for i in range(1, len(raw_points)):
            current_pt = raw_points[i]
            prev_pt = clean_points[-1]
            
            # distance check
            if current_pt.DistanceTo(prev_pt) > Rhino.RhinoMath.ZeroTolerance:
                clean_points.append(current_pt)
            else:
                # Debug log optional: found duplicate
                pass

    # --- 3. Polyline Construction ---
    final_poly = None
    path_length = 0.0
    
    if len(clean_points) >= 2:
        try:
            # PolylineCurve is generally more robust
            ply_crv = rg.PolylineCurve(clean_points)
            
            if ply_crv.IsValid:
                path_length = ply_crv.GetLength()
                final_poly = ply_crv
            else:
                debug_log.append("Error: Cleaned points still produced invalid Polyline.")
        except Exception as e:
             debug_log.append(f"Error creating polyline: {e}")
    else:
        debug_log.append(f"Error: After cleaning, only {len(clean_points)} points remained (need 2+).")

    # --- 4. Header Construction ---
    def fmt_min(vals, label): return f";{label}: {min(vals):.2f}" if vals else f";{label}: N/A"
    def fmt_max(vals, label): return f";{label}: {max(vals):.2f}" if vals else f";{label}: N/A"

    date_str = datetime.datetime.now().strftime("%d-%b-%Y %H:%M")
    
    header = []
    header.append(f";Date Generated {date_str}")
    header.append(f";Generated using {s_name}")
    header.append(f";Total Travel Length: {path_length:.2f}")
    header.append(fmt_min(x_vals, "Min X"))
    header.append(fmt_max(x_vals, "Max X"))
    header.append(fmt_min(y_vals, "Min Y"))
    header.append(fmt_max(y_vals, "Max Y"))
    header.append(fmt_min(z_vals, "Min Z"))
    header.append(fmt_max(z_vals, "Max Z"))
    header.append(fmt_min(f_vals, "Min Feed"))
    header.append(fmt_max(f_vals, "Max Feed"))
    header.append(fmt_min(s_vals, "Min Speed"))
    header.append(fmt_max(s_vals, "Max Speed"))
    
    total_lines = original_line_count + len(header) + 1
    header.append(f";Total Gcode Lines {total_lines}")
    
    full_header_str = "\n".join(header)
    final_text_output = full_header_str + "\n\n" + raw_text
    
    return final_poly, final_text_output, clean_points, debug_log

# --- Execution ---
Polyline = None
ModifiedGcode = ""
PointList = []

try:
    poly, text, pts, logs = process_gcode(gcode_text, script_name)
    
    Polyline = poly
    ModifiedGcode = text
    PointList = pts
    
    for l in logs:
        print(l)
        
except Exception as e:
    print(f"Critical Script Error: {str(e)}")
# ---------- end py3_3 ----------
py3_4 = Python3Script(gcode_text=gengcode.GCode, script_name="cncProfiler v0.10.0")  # -> out, Polyline, ModifiedGcode, PointList; inputs gcode_text: String, script_name: String
# ---------- py3_4: Python ----------
"""
Parses G-code, cleans consecutive duplicate points, and generates geometry/stats.
Inputs:
    gcode_text: Raw G-code string
    script_name: Name for the header
Outputs:
    Polyline: The resulting curve(s)
    ModifiedGcode: Text with stats header
    PointList: The CLEANED list of points
"""

import math
import Rhino
import Rhino.Geometry as rg
import datetime

def process_gcode(raw_text, s_name):
    debug_log = []
    
    if not raw_text:
        return None, "Error: Input text is empty.", [], debug_log
    
    if not s_name:
        s_name = "Grasshopper Script"

    lines = raw_text.splitlines()
    original_line_count = len(lines)
    
    # --- 1. Parsing Logic ---
    curves = []
    clean_points = []
    
    current_x = 0.0
    current_y = 0.0
    current_z = 0.0
    
    # Stats
    x_vals = []
    y_vals = []
    z_vals = []
    f_vals = []
    s_vals = []
    path_length = 0.0
    
    for line in lines:
        clean_line = line.strip().upper()
        if ";" in clean_line:
            clean_line = clean_line.split(";")[0].strip()
        
        if not clean_line:
            continue

        parts = clean_line.split()
        
        # F/S Parsing
        for part in parts:
            try:
                if part.startswith("S"):
                    s_vals.append(float(part[1:]))
                elif part.startswith("F"):
                    f_vals.append(float(part[1:]))
            except:
                pass

        is_G1 = clean_line.startswith("G1")
        is_G2 = clean_line.startswith("G2")
        is_G3 = clean_line.startswith("G3")
        
        # G0 typically indicates a rapid move, but we only draw cut paths.
        # If you want to include G0 moves as well, add is_G0 here.
        # Original logic only watched G1 to build geometry. 
        if is_G1 or is_G2 or is_G3:
            target_x = current_x
            target_y = current_y
            target_z = current_z
            i_val = 0.0
            j_val = 0.0
            
            geometry_updated = False
            for part in parts:
                try:
                    if len(part) > 1:
                        if part.startswith("X"):
                            target_x = float(part[1:])
                            geometry_updated = True
                        elif part.startswith("Y"):
                            target_y = float(part[1:])
                            geometry_updated = True
                        elif part.startswith("Z"):
                            target_z = float(part[1:])
                            geometry_updated = True
                        elif part.startswith("I"):
                            i_val = float(part[1:])
                        elif part.startswith("J"):
                            j_val = float(part[1:])
                except ValueError:
                    continue
            
            if geometry_updated:
                start_pt = rg.Point3d(current_x, current_y, current_z)
                end_pt = rg.Point3d(target_x, target_y, target_z)
                
                if not clean_points:
                    clean_points.append(start_pt)
                    x_vals.append(current_x)
                    y_vals.append(current_y)
                    z_vals.append(current_z)

                dist = start_pt.DistanceTo(end_pt)
                is_full_circle = dist < Rhino.RhinoMath.ZeroTolerance
                
                # Construct Geometry
                if is_G1 and not is_full_circle:
                    crv = rg.LineCurve(start_pt, end_pt)
                    curves.append(crv)
                    path_length += crv.GetLength()
                    
                elif (is_G2 or is_G3) and (i_val != 0 or j_val != 0):
                    center_pt = rg.Point3d(current_x + i_val, current_y + j_val, current_z)
                    radius = center_pt.DistanceTo(start_pt)
                    
                    if radius > Rhino.RhinoMath.ZeroTolerance:
                        angle1 = math.atan2(current_y - center_pt.Y, current_x - center_pt.X)
                        angle2 = math.atan2(target_y - center_pt.Y, target_x - center_pt.X)
                        
                        if angle1 < 0: angle1 += 2 * math.pi
                        if angle2 < 0: angle2 += 2 * math.pi
                        
                        if is_G2:  # Clockwise
                            sweep = angle2 - angle1
                            if sweep > 0: sweep -= 2 * math.pi
                            if is_full_circle: sweep = -2 * math.pi
                        else:      # Counter-Clockwise
                            sweep = angle2 - angle1
                            if sweep < 0: sweep += 2 * math.pi
                            if is_full_circle: sweep = 2 * math.pi
                            
                        # Arc construction: define plane at center
                        # X-axis of plane points to Start Point
                        x_dir = start_pt - center_pt
                        x_dir.Unitize()
                        y_dir = rg.Vector3d(-x_dir.Y, x_dir.X, 0)
                        plane = rg.Plane(center_pt, x_dir, y_dir)
                        
                        # Create arc domain from 0 to positive or negative sweep
                        arc = rg.Arc(plane, radius, sweep)
                        crv = rg.ArcCurve(arc)
                        curves.append(crv)
                        path_length += crv.GetLength()

                # Update current state
                current_x = target_x
                current_y = target_y
                current_z = target_z
                
                if end_pt.DistanceTo(clean_points[-1]) > Rhino.RhinoMath.ZeroTolerance:
                    clean_points.append(end_pt)
                
                x_vals.append(current_x)
                y_vals.append(current_y)
                z_vals.append(current_z)

    # Output discrete curves instead of a single merged polyline,
    # as Grasshopper can natively output lists of curves robustly.
    final_poly = curves

    # --- 4. Header Construction ---
    def fmt_min(vals, label): return f";{label}: {min(vals):.2f}" if vals else f";{label}: N/A"
    def fmt_max(vals, label): return f";{label}: {max(vals):.2f}" if vals else f";{label}: N/A"

    date_str = datetime.datetime.now().strftime("%d-%b-%Y %H:%M")
    
    header = []
    header.append(f";Date Generated {date_str}")
    header.append(f";Generated using {s_name}")
    header.append(f";Total Travel Length: {path_length:.2f}")
    header.append(fmt_min(x_vals, "Min X"))
    header.append(fmt_max(x_vals, "Max X"))
    header.append(fmt_min(y_vals, "Min Y"))
    header.append(fmt_max(y_vals, "Max Y"))
    header.append(fmt_min(z_vals, "Min Z"))
    header.append(fmt_max(z_vals, "Max Z"))
    header.append(fmt_min(f_vals, "Min Feed"))
    header.append(fmt_max(f_vals, "Max Feed"))
    header.append(fmt_min(s_vals, "Min Speed"))
    header.append(fmt_max(s_vals, "Max Speed"))
    
    total_lines = original_line_count + len(header) + 1
    header.append(f";Total Gcode Lines {total_lines}")
    
    full_header_str = "\n".join(header)
    final_text_output = full_header_str + "\n\n" + raw_text
    
    return final_poly, final_text_output, clean_points, debug_log

# --- Execution ---
Polyline = None
ModifiedGcode = ""
PointList = []

try:
    poly_list, text, pts, logs = process_gcode(gcode_text, script_name)
    
    Polyline = poly_list
    ModifiedGcode = text
    PointList = pts
    
    for l in logs:
        print(l)
        
except Exception as e:
    print(f"Critical Script Error: {str(e)}")
# ---------- end py3_4 ----------
gcv = GCodeVisualizer(
    GCode=gengcode.GCode,
    RapidMovementColor=RGB(4, 50, 255),
    CuttingMovementColor=RGB(255, 38, 0),
    CircularMovementColor=RGB(0, 142, 0),
    ScalingFactor=1,
    Offset=Point(0, 0, 0))  # -> VisualizedToolpaths, Legend
flatten = FlattenTree(Tree=py3_2.CleanTree, Path="{0}")
flatten_2 = FlattenTree(Tree=pshift_2, Path="{0}")
flatten_3 = FlattenTree(Tree=wrapper_for_active_doc.CurveOut, Path="{0}")
c_bake_2 = ContextBake(UnusedLines=flatten)
c_bake_3 = ContextBake(BadLines=flatten_2)
c_bake_4 = ContextBake(DxfLines=flatten_3)
c_bake_5 = ContextBake(Content=py3_3.Polyline)
c_print = ContextPrint(GCode=py3_3.ModifiedGcode)
c_print_2 = ContextPrint(Text=entwine_2)

# ==== cluster GetCurvesByLayer
T = ClusterInput()
P = ClusterInput()
tmatch = MatchText(Text=T, Pattern=P, Case=False)
L = ClusterInput()
sift = SiftPattern(List=L, SiftPattern=tmatch)  # -> Output0, Output1
clean = CleanTree(RemoveNulls=True, RemoveInvalid=True, RemoveEmpty=False, Tree=sift.Output1)
concat = Concatenate(FragmentA="{", FragmentB=clean, FragmentC="}")
T_2 = ClusterInput()
branch = TreeBranch(Tree=T_2, Path=concat, MaintainPaths=True)
tpo = ToolpathOptimizer(Curves=branch)
branch_2 = ClusterOutput(concat)
ot = ClusterOutput(tpo)

# ==== cluster CutPathAndTabs
B = ClusterInput()
B_2 = ClusterInput()
cut_through_depth = ClusterInput()
D = ClusterInput()
C = ClusterInput()
G = ClusterInput()
O = ClusterInput()
td = ClusterInput()
cd = ClusterInput()
sd = ClusterInput()
silmilling = SilhouetteMilling(BoundaryCurve=C, ToolDiameter=td, OffsetOption=O, Tolerance=0.01, CutDepth=cd, Stepdown=sd, CutMode=0, OffsetStyle=0)
addition = Addition(A=cut_through_depth, B=B_2)
validation_redout = ValidationRedout(I=silmilling, A="There were ", C="  profile cut curves made from the input curve", _1="No Profile curves made")
validation_redout_2 = ValidationRedout(
    I=C,
    A="There were ",
    C="  profile cut curves successfully loaded into the cluster",
    _1="No curves loaded into the cluster")
filter = StreamFilter(Gate=O, Stream0="Profile: Inside", Stream1="Profile: Centered", Stream2="Profile: Outside")
add_bridging = AddBridging(L=silmilling, cutthrough_depth=cut_through_depth, bridge_height=addition, D=D, B=B)  # -> out, A
filter_2 = StreamFilter(Gate=G, Stream0="No Bridging Added", Stream1=add_bridging.out)
merge = Merge(Data1=filter, Data2=flatten(validation_redout_2), Data3=flatten(validation_redout), Data4=flatten(filter_2))  # -> flatten(Result)
filter_3 = StreamFilter(Gate=G, Stream0=silmilling, Stream1=add_bridging.A)
profile_curves = ClusterOutput(filter_3)
R = ClusterOutput(merge)

# ==== cluster ValidationRedout_2
I = ClusterInput()
A = ClusterInput()
C = ClusterInput()
null = NullItem(Item=I)  # -> NullFlags, InvalidFlags, Description
lng = ListLength(List=null.Description)
ma = MassAddition(Input=null.NullFlags)  # -> Result, PartialResults
_1 = ClusterInput()
concat = Concatenate(FragmentA=A, FragmentB=lng, FragmentC=C)
filter = StreamFilter(Gate=ma.Result, Stream0=concat, Stream1=_1)
stream = ClusterOutput(filter)

# ==== cluster ValidationRedout
I = ClusterInput()
A = ClusterInput()
C = ClusterInput()
null = NullItem(Item=I)  # -> NullFlags, InvalidFlags, Description
lng = ListLength(List=null.Description)
ma = MassAddition(Input=null.NullFlags)  # -> Result, PartialResults
_1 = ClusterInput()
concat = Concatenate(FragmentA=A, FragmentB=lng, FragmentC=C)
filter = StreamFilter(Gate=ma.Result, Stream0=concat, Stream1=_1)
s_0 = ClusterOutput(filter)

# ==== cluster AddBridging
cutthrough_depth = ClusterInput()
L = ClusterInput()
addition = Addition(A=cutthrough_depth, B=0)
B = ClusterInput()
item = ListItem(List=reverse(L), Index=0, Wrap=True)
Z = UnitZ(Factor=addition)
move = Move(Geometry=item, Motion=expr("-x", Z))  # -> Geometry, Transform
len = Length(Curve=move.Geometry)
division = Division(A=len, B=B)
round = Round(Number=division)  # -> Nearest, Floor, Ceiling
max = Maximum(A=round.Ceiling, B="3")
divide = DivideCurve(Curve=move.Geometry, Count=max, Kinks=False)  # -> Points, Tangents, Parameters
bridge_height = ClusterInput()
D = ClusterInput()
c_script = CSharpScript(C=move.Geometry, t=divide.Parameters, D=D)  # -> out, t_plus, t_minus; inputs C: Curve, t: Double, D: Double
# ---------- c_script: C# ----------
// Grasshopper Script Instance
#region Usings
using System;
using System.Linq;
using System.Collections;
using System.Collections.Generic;
using System.Drawing;

using Rhino;
using Rhino.Geometry;

using Grasshopper;
using Grasshopper.Kernel;
using Grasshopper.Kernel.Data;
using Grasshopper.Kernel.Types;
#endregion

public class Script_Instance : GH_ScriptInstance
{
    #region Notes
    /* 
      Members:
        RhinoDoc RhinoDocument
        GH_Document GrasshopperDocument
        IGH_Component Component
        int Iteration

      Methods (Virtual & overridable):
        Print(string text)
        Print(string format, params object[] args)
        Reflect(object obj)
        Reflect(object obj, string method_name)
    */
    #endregion

    // --- Start changing code here ---
  private void RunScript(
		Curve C,
		double t,
		double D,
		ref object t_plus,
		ref object t_minus)
  {
    // --- 1. VALIDATE INPUTS ---
    if (C == null)
    {
      Component.AddRuntimeMessage(GH_RuntimeMessageLevel.Error, "Input 'C' failed to collect data. Curve cannot be null.");
      return;
    }
    if (!C.IsValid)
    {
      Component.AddRuntimeMessage(GH_RuntimeMessageLevel.Error, "The provided curve is not valid.");
      return;
    }
    if (D < 0)
    {
        Component.AddRuntimeMessage(GH_RuntimeMessageLevel.Warning, "Distance 'D' is negative. Using its absolute value.");
        D = Math.Abs(D);
    }

    // --- 2. CORE LOGIC ---
    
    // It's good practice to ensure the input parameter 't' is within the curve's domain.
    // We clamp the value to be safe.
    double clamped_t = Math.Max(C.Domain.Min, Math.Min(C.Domain.Max, t));
    if (clamped_t != t)
    {
        Component.AddRuntimeMessage(GH_RuntimeMessageLevel.Warning, "Input parameter 't' was outside the curve's domain and has been clamped.");
    }

    // Calculate the length of the curve from its start point to the point at our parameter 't'.
    // We do this by creating a sub-domain of the curve and getting its length.
    Interval subDomain = new Interval(C.Domain.Min, clamped_t);
    double lengthAtT = C.GetLength(subDomain);

    // Calculate the target arc lengths by adding and subtracting the distance.
    double targetLengthPlus = lengthAtT + D;
    double targetLengthMinus = lengthAtT - D;

    // Now, convert these arc lengths back into curve parameters.
    // RhinoCommon's LengthParameter method handles this perfectly.
    // It automatically clamps the result to the start or end of the curve if the
    // target length is outside the possible range [0, TotalCurveLength].
    double out_t_plus, out_t_minus;
    
    C.LengthParameter(targetLengthPlus, out out_t_plus);
    C.LengthParameter(targetLengthMinus, out out_t_minus);
    
    // --- 3. ASSIGN OUTPUTS ---
    t_plus = out_t_plus;
    t_minus = out_t_minus;
  }
  // --- End changing code here ---
}
# ---------- end c_script ----------
c_script_2 = CSharpScript(C=move.Geometry, t_minus=c_script.t_minus, t_plus=c_script.t_plus, H=bridge_height)  # -> out, MovedCurves; inputs C: Curve, t_minus: list of Double, t_plus: list of Double, H: Double
# ---------- c_script_2: C# ----------
// Grasshopper Script Instance
#region Usings
using System;
using System.Linq;
using System.Collections;
using System.Collections.Generic;
using System.Drawing;

using Rhino;
using Rhino.Geometry;

using Grasshopper;
using Grasshopper.Kernel;
using Grasshopper.Kernel.Data;
using Grasshopper.Kernel.Types;
#endregion

public class Script_Instance : GH_ScriptInstance
{
    #region Notes
    /* 
      Members:
        RhinoDoc RhinoDocument
        GH_Document GrasshopperDocument
        IGH_Component Component
        int Iteration

      Methods (Virtual & overridable):
        Print(string text)
        Print(string format, params object[] args)
        Reflect(object obj)
        Reflect(object obj, string method_name)
    */
    #endregion

    // --- Start changing code here ---
  private void RunScript(
		Curve C,
		List<double> t_minus,
		List<double> t_plus,
		double H,
		ref object MovedCurves)
  {
    // --- 1. VALIDATE INPUTS ---
    if (C == null)
    {
      Component.AddRuntimeMessage(GH_RuntimeMessageLevel.Error, "Input 'C' failed to collect data. Curve cannot be null.");
      return;
    }
    if (!C.IsValid)
    {
      Component.AddRuntimeMessage(GH_RuntimeMessageLevel.Error, "The provided curve is not valid.");
      return;
    }
    if (t_minus.Count != t_plus.Count)
    {
      Component.AddRuntimeMessage(GH_RuntimeMessageLevel.Error, "Input lists 't_minus' and 't_plus' must have the same number of items.");
      return;
    }

    // --- 2. PREPARE FOR SPLIT ---
    List<double> splitParams = new List<double>();
    splitParams.AddRange(t_minus);
    splitParams.AddRange(t_plus);
    
    double curveDomainMin = C.Domain.Min;
    double curveDomainMax = C.Domain.Max;

    // Sort and filter parameters to be strictly within the curve's domain.
    List<double> uniqueSortedParams = splitParams.Distinct().Where(p => p > curveDomainMin && p < curveDomainMax).ToList();
    uniqueSortedParams.Sort();

    // --- 3. SPLIT THE CURVE ---
    Curve[] splitSegments = C.Split(uniqueSortedParams);

    if (splitSegments == null || splitSegments.Length == 0)
    {
      Component.AddRuntimeMessage(GH_RuntimeMessageLevel.Warning, "Splitting the curve resulted in no segments.");
      MovedCurves = new List<Curve> { C };
      return;
    }

    // --- 4. PROCESS SEGMENTS (IDENTIFY, MOVE, AND STORE) ---
    List<Curve> processedSegments = new List<Curve>();
    Vector3d moveVector = new Vector3d(0, 0, H);

    foreach (Curve segment in splitSegments)
    {
      if (segment == null) continue;

      double midParam = (segment.Domain.Min + segment.Domain.Max) / 2.0;
      bool shouldMove = false;

      for (int i = 0; i < t_minus.Count; i++)
      {
        double start = Math.Min(t_minus[i], t_plus[i]);
        double end = Math.Max(t_minus[i], t_plus[i]);

        if (midParam > start && midParam < end)
        {
          shouldMove = true;
          break;
        }
      }

      if (shouldMove)
      {
        Curve movedSegment = segment.DuplicateCurve();
        movedSegment.Transform(Transform.Translation(moveVector));
        processedSegments.Add(movedSegment);
      }
      else
      {
        processedSegments.Add(segment);
      }
    }

    // --- 5. ADD CONNECTING LINES ---
    List<Curve> finalCurves = new List<Curve>();
    finalCurves.AddRange(processedSegments); // Add all the main segments first.

    // Iterate through the processed segments to find gaps to connect.
    for (int i = 0; i < processedSegments.Count - 1; i++)
    {
      Curve seg1 = processedSegments[i];
      Curve seg2 = processedSegments[i + 1];

      Point3d pt1_End = seg1.PointAtEnd;
      Point3d pt2_Start = seg2.PointAtStart;

      // If the end of one segment is not at the same location as the start of the next,
      // it means a translation occurred and we need to add a connector.
      if (pt1_End.DistanceTo(pt2_Start) > 1e-6) // Use a small tolerance
      {
        finalCurves.Add(new LineCurve(pt1_End, pt2_Start));
      }
    }

    // --- 6. ASSIGN OUTPUTS ---
    MovedCurves = finalCurves;
    Print("bridging added to the given line");
  }
  // --- End changing code here ---
}
# ---------- end c_script_2 ----------
join = JoinCurves(Curves=c_script_2.MovedCurves, Preserve=False)
out = ClusterOutput(c_script_2.out)
replace = ReplaceItems(List=reverse(L), Item=join, Indices="0", Wrap=False)  # -> reverse(List)
alicrvseams = AlignCurveSeams(Curves=replace, Snap=False, Iterative=True)  # -> Aligned, Points, R
A = ClusterOutput(alicrvseams.Aligned)
