# Grasshopper definition simple test.gh (Grasshopper 1.0.8)
# Copyright: 2025

give_me_your_name = GetString("Cameron", AtLeast=1, AtMost=1, TreeAccess=False)
concat = Concatenate(FragmentA="Hello,", FragmentB=give_me_your_name, FragmentC="! We are glad this test passed :)")
c_print = ContextPrint(Text=concat)
